# Dynamo graph C3D Property Exporter.dyn (Dynamo 3.4.1.7055)

# group: Input the target xlsx with full path
output_xlsx_w_path = StringInput("D:\Users\LI_Y1\Desktop\DWG_Properties.xlsx")

run = BoolSelector(true)
include_layout = BoolSelector(true)
include_block = BoolSelector(false)
python_script = Python(IN[0]=output_xlsx_w_path, IN[1]=run, IN[2]=include_layout, IN[3]=include_block)  # CPython3
# ---------- python_script.python (1163 lines) ----------
# -*- coding: utf-8 -*-
# Dynamo for Civil 3D / CPython3
#
# 输入：
# IN[0] = 完整XLSX输出路径
# IN[1] = 是否执行
# IN[2] = 是否包含全部布局
# IN[3] = 是否额外扫描本地块定义
#
# 输出：
# OUT = 状态、文件路径、对象数量、日志预览
#
# 依赖：
# Civil 3D随软件安装的.NET程序集
# Python标准库
# 不需要Excel、openpyxl或第三方Dynamo包
#
# 只读DWG，不创建或修改对象及Property Sets。
# 已存在的目标XLSX会被覆盖。

import os
import re
import math
import numbers
import tempfile
import zipfile
import traceback
import xml.etree.ElementTree as ET

from datetime import datetime
from types import SimpleNamespace


LOG = []
STAGE = "初始化"


# ============================================================
# 日志和属性读取
# ============================================================

def log(handle, stage, message):
    LOG.append([
        str(handle) if handle is not None else "",
        str(stage),
        str(message)
    ])


def read(obj, name, handle=""):
    """属性不存在时返回None；存在但读取失败时记录日志。"""
    try:
        prop = obj.GetType().GetProperty(name)

        if prop is None:
            return None

        return getattr(obj, name)

    except Exception as ex:
        log(handle, "读取属性：" + name, ex)
        return None


def first(obj, names, handle=""):
    """按顺序读取第一个非空属性。"""
    for name in names:
        value = read(obj, name, handle)

        if value is not None and str(value) != "":
            return value

    return None


def plain(value):
    """将.NET/Python值转换为Excel可写入的基础类型。"""
    if value is None:
        return None

    if isinstance(value, bool):
        return value

    if isinstance(value, numbers.Integral):
        return int(value)

    if isinstance(value, numbers.Real):
        number = float(value)
        return number if math.isfinite(number) else str(number)

    try:
        type_name = value.GetType().FullName

        if type_name == "System.Boolean":
            return bool(value)

        integer_types = (
            "System.Byte",
            "System.SByte",
            "System.Int16",
            "System.Int32",
            "System.Int64",
            "System.UInt16",
            "System.UInt32",
            "System.UInt64"
        )

        real_types = (
            "System.Double",
            "System.Single",
            "System.Decimal"
        )

        if type_name in integer_types:
            return int(value)

        if type_name in real_types:
            number = float(value)
            return number if math.isfinite(number) else str(number)

    except Exception:
        pass

    return str(value)


def object_name(tr, oid, handle=""):
    """通过ObjectId读取样式、材料或块定义名称。"""
    if oid is None:
        return None

    try:
        if oid.IsNull:
            return None

        obj = tr.GetObject(oid, OpenMode.ForRead)
        return read(obj, "Name", handle)

    except Exception as ex:
        log(handle, "解析ObjectId名称", ex)
        return None


# ============================================================
# 特征线枚举修复
# ============================================================

def resolve_feature_line_points(clr_module, feature_line_class):
    """
    从GetPoints方法的枚举参数类型读取AllPoints字段。
    不导入FeatureLinePointType。
    不调用Enum.GetNames或Enum.Parse。
    """
    feature_line_type = clr_module.GetClrType(feature_line_class)

    for method in feature_line_type.GetMethods():
        if method.Name != "GetPoints":
            continue

        parameters = method.GetParameters()

        if len(parameters) != 1:
            continue

        enum_type = parameters[0].ParameterType

        if not enum_type.IsEnum:
            continue

        field = enum_type.GetField("AllPoints")

        if field is None:
            continue

        value = field.GetValue(None)

        if value is not None:
            return SimpleNamespace(AllPoints=value)

    raise RuntimeError(
        "当前Civil 3D API中未找到"
        "FeatureLine.GetPoints所需的AllPoints枚举字段。"
    )


# ============================================================
# 顶点读取
# ============================================================

def vertex_points(obj, tr):
    """
    支持：
    Polyline、Polyline2d、Polyline3d、
    FeatureLine、Line、CogoPoint、DBPoint。

    普通空间中的坐标按WCS读取。
    块定义中的坐标为定义坐标，不进行实例变换。
    """
    if isinstance(obj, Polyline):
        points = [
            obj.GetPoint3dAt(i)
            for i in range(obj.NumberOfVertices)
        ]
        return points, "Polyline vertices"

    if isinstance(obj, Polyline3d):
        points = []

        for vertex_id in obj:
            vertex = tr.GetObject(vertex_id, OpenMode.ForRead)
            points.append(vertex.Position)

        return points, "Polyline3d vertices"

    if isinstance(obj, Polyline2d):
        points = []
        matrix = Matrix3d.PlaneToWorld(obj.Normal)

        for vertex_id in obj:
            vertex = tr.GetObject(vertex_id, OpenMode.ForRead)
            position = vertex.Position

            point = Point3d(
                position.X,
                position.Y,
                obj.Elevation
            ).TransformBy(matrix)

            points.append(point)

        return points, "Polyline2d vertices"

    if isinstance(obj, FeatureLine):
        if FeatureLinePointType is None:
            raise RuntimeError(
                "特征线AllPoints枚举初始化失败，"
                "请检查Log中的FeatureLine enum记录。"
            )

        points = list(
            obj.GetPoints(FeatureLinePointType.AllPoints)
        )

        return points, "FeatureLine points"

    if isinstance(obj, Line):
        return [
            obj.StartPoint,
            obj.EndPoint
        ], "Line endpoints"

    if isinstance(obj, CogoPoint):
        return [
            Point3d(
                obj.Easting,
                obj.Northing,
                obj.Elevation
            )
        ], "COGO location"

    if isinstance(obj, DBPoint):
        return [obj.Position], "Point location"

    return [], "Not applicable / not implemented"


# ============================================================
# XLSX生成：仅使用Python标准库
# ============================================================

MAIN_NS = (
    "http://schemas.openxmlformats.org/"
    "spreadsheetml/2006/main"
)

REL_NS = (
    "http://schemas.openxmlformats.org/"
    "officeDocument/2006/relationships"
)

PACKAGE_NS = (
    "http://schemas.openxmlformats.org/"
    "package/2006/relationships"
)

CONTENT_NS = (
    "http://schemas.openxmlformats.org/"
    "package/2006/content-types"
)

ET.register_namespace("", MAIN_NS)
ET.register_namespace("r", REL_NS)


def tag(namespace, name):
    return "{" + namespace + "}" + name


def column_name(index):
    result = ""

    while index:
        index, remainder = divmod(index - 1, 26)
        result = chr(65 + remainder) + result

    return result


def xml_bytes(root):
    return ET.tostring(
        root,
        encoding="utf-8",
        xml_declaration=True
    )


def clean_xml_text(value):
    """删除XML不允许的控制字符和孤立代理字符。"""
    return re.sub(
        r"[\x00-\x08\x0B\x0C\x0E-\x1F"
        r"\uD800-\uDFFF\uFFFE\uFFFF]",
        "",
        str(value)
    )


def sheet_xml(rows):
    root = ET.Element(tag(MAIN_NS, "worksheet"))
    data = ET.SubElement(root, tag(MAIN_NS, "sheetData"))

    for row_index, values in enumerate(rows, 1):
        row = ET.SubElement(
            data,
            tag(MAIN_NS, "row"),
            {"r": str(row_index)}
        )

        for column_index, raw_value in enumerate(values, 1):
            value = plain(raw_value)

            if value is None:
                continue

            address = column_name(column_index) + str(row_index)

            cell = ET.SubElement(
                row,
                tag(MAIN_NS, "c"),
                {"r": address}
            )

            if isinstance(value, bool):
                cell.set("t", "b")

                ET.SubElement(
                    cell,
                    tag(MAIN_NS, "v")
                ).text = "1" if value else "0"

            elif isinstance(value, (int, float)):
                # 长整数按文本写入，避免Excel数字精度损失。
                if isinstance(value, int) and len(str(abs(value))) > 15:
                    cell.set("t", "inlineStr")
                    inline = ET.SubElement(cell, tag(MAIN_NS, "is"))
                    ET.SubElement(
                        inline,
                        tag(MAIN_NS, "t")
                    ).text = str(value)
                else:
                    ET.SubElement(
                        cell,
                        tag(MAIN_NS, "v")
                    ).text = str(value)

            else:
                text = clean_xml_text(value)

                if len(text) > 32767:
                    raise ValueError(
                        "单元格文本超过32767字符：" + address
                    )

                # 作为文本写入，避免属性值被识别为Excel公式。
                cell.set("t", "inlineStr")
                inline = ET.SubElement(cell, tag(MAIN_NS, "is"))
                text_node = ET.SubElement(
                    inline,
                    tag(MAIN_NS, "t")
                )

                text_node.set(
                    "{http://www.w3.org/XML/1998/namespace}space",
                    "preserve"
                )
                text_node.text = text

    return xml_bytes(root)


def write_xlsx(path, sheets):
    """先写临时文件，成功后替换目标文件。"""
    for sheet_name, rows in sheets:
        if len(rows) > 1048576:
            raise ValueError(
                sheet_name + " 超过Excel工作表行数上限"
            )

        if any(len(row) > 16384 for row in rows):
            raise ValueError(
                sheet_name + " 超过Excel工作表列数上限"
            )

    folder = os.path.dirname(path)
    os.makedirs(folder, exist_ok=True)

    file_descriptor, temporary_path = tempfile.mkstemp(
        suffix=".xlsx",
        dir=folder
    )
    os.close(file_descriptor)

    try:
        workbook = ET.Element(tag(MAIN_NS, "workbook"))
        sheet_nodes = ET.SubElement(
            workbook,
            tag(MAIN_NS, "sheets")
        )

        workbook_relationships = ET.Element(
            tag(PACKAGE_NS, "Relationships")
        )

        content_types = ET.Element(
            tag(CONTENT_NS, "Types")
        )

        ET.SubElement(
            content_types,
            tag(CONTENT_NS, "Default"),
            {
                "Extension": "rels",
                "ContentType":
                    "application/vnd.openxmlformats-package."
                    "relationships+xml"
            }
        )

        ET.SubElement(
            content_types,
            tag(CONTENT_NS, "Default"),
            {
                "Extension": "xml",
                "ContentType": "application/xml"
            }
        )

        ET.SubElement(
            content_types,
            tag(CONTENT_NS, "Override"),
            {
                "PartName": "/xl/workbook.xml",
                "ContentType":
                    "application/vnd.openxmlformats-officedocument."
                    "spreadsheetml.sheet.main+xml"
            }
        )

        root_relationships = ET.Element(
            tag(PACKAGE_NS, "Relationships")
        )

        ET.SubElement(
            root_relationships,
            tag(PACKAGE_NS, "Relationship"),
            {
                "Id": "rId1",
                "Type": REL_NS + "/officeDocument",
                "Target": "xl/workbook.xml"
            }
        )

        with zipfile.ZipFile(
            temporary_path,
            "w",
            zipfile.ZIP_DEFLATED
        ) as archive:

            for index, (sheet_name, rows) in enumerate(sheets, 1):
                relationship_id = "rId" + str(index)
                sheet_file = "sheet{}.xml".format(index)

                ET.SubElement(
                    sheet_nodes,
                    tag(MAIN_NS, "sheet"),
                    {
                        "name": sheet_name,
                        "sheetId": str(index),
                        tag(REL_NS, "id"): relationship_id
                    }
                )

                ET.SubElement(
                    workbook_relationships,
                    tag(PACKAGE_NS, "Relationship"),
                    {
                        "Id": relationship_id,
                        "Type": REL_NS + "/worksheet",
                        "Target": "worksheets/" + sheet_file
                    }
                )

                ET.SubElement(
                    content_types,
                    tag(CONTENT_NS, "Override"),
                    {
                        "PartName": "/xl/worksheets/" + sheet_file,
                        "ContentType":
                            "application/vnd.openxmlformats-officedocument."
                            "spreadsheetml.worksheet+xml"
                    }
                )

                archive.writestr(
                    "xl/worksheets/" + sheet_file,
                    sheet_xml(rows)
                )

            archive.writestr(
                "[Content_Types].xml",
                xml_bytes(content_types)
            )

            archive.writestr(
                "_rels/.rels",
                xml_bytes(root_relationships)
            )

            archive.writestr(
                "xl/workbook.xml",
                xml_bytes(workbook)
            )

            archive.writestr(
                "xl/_rels/workbook.xml.rels",
                xml_bytes(workbook_relationships)
            )

        os.replace(temporary_path, path)

    finally:
        if os.path.exists(temporary_path):
            os.remove(temporary_path)


# ============================================================
# 主程序
# ============================================================

def export():
    global STAGE
    global OpenMode, Entity, Curve, BlockReference
    global Polyline, Polyline2d, Polyline3d, Line, DBPoint
    global CogoPoint, FeatureLine, FeatureLinePointType
    global Point3d, Matrix3d

    STAGE = "检查输入"

    if len(IN) < 4:
        raise ValueError("Python节点必须设置4个输入端口")

    if not bool(IN[1]):
        return {"Status": "未执行"}

    if not isinstance(IN[0], str) or not IN[0].strip():
        raise ValueError("IN[0]必须是非空的XLSX路径字符串")

    raw_path = IN[0].strip()

    if not os.path.isabs(raw_path):
        raise ValueError(
            "IN[0]必须是完整绝对路径，例如："
            r"D:\BIM_Export\DWG_Properties.xlsx"
        )

    path = os.path.abspath(raw_path)

    if not path.lower().endswith(".xlsx"):
        raise ValueError("输出文件扩展名必须为.xlsx")

    include_layouts = bool(IN[2])
    include_blocks = bool(IN[3])

    STAGE = "加载.NET程序集"

    import clr

    for assembly in (
        "AcMgd",
        "AcCoreMgd",
        "AcDbMgd",
        "AecBaseMgd",
        "AecPropDataMgd",
        "AeccDbMgd"
    ):
        clr.AddReference(assembly)

    from Autodesk.AutoCAD.ApplicationServices import Application

    from Autodesk.AutoCAD.DatabaseServices import (
        OpenMode,
        Entity,
        Curve,
        BlockReference,
        Polyline,
        Polyline2d,
        Polyline3d,
        Line,
        DBPoint
    )

    from Autodesk.AutoCAD.Geometry import (
        Point3d,
        Matrix3d
    )

    # 不从DatabaseServices导入FeatureLinePointType。
    from Autodesk.Civil.DatabaseServices import (
        CogoPoint,
        FeatureLine
    )

    from Autodesk.Aec.PropertyData.DatabaseServices import (
        PropertyDataServices
    )

    STAGE = "初始化特征线枚举"

    FeatureLinePointType = None

    try:
        FeatureLinePointType = resolve_feature_line_points(
            clr,
            FeatureLine
        )
    except Exception as ex:
        # 特征线顶点功能失败时，仍继续导出其他对象和属性。
        log("", "FeatureLine enum", ex)

    STAGE = "获取当前DWG"

    doc = Application.DocumentManager.MdiActiveDocument

    if doc is None:
        raise RuntimeError("没有活动DWG文档")

    db = doc.Database
    drawing_name = str(doc.Name)
    drawing_units = str(db.Insunits)

    records = []
    vertices = []
    properties = []
    pset_columns = set()

    scanned = 0
    skipped_xref_definitions = 0
    seen_handles = set()

    STAGE = "读取DWG对象"

    document_lock = doc.LockDocument()
    transaction = None

    try:
        transaction = db.TransactionManager.StartTransaction()

        block_table = transaction.GetObject(
            db.BlockTableId,
            OpenMode.ForRead
        )

        for block_id in block_table:
            try:
                block = transaction.GetObject(
                    block_id,
                    OpenMode.ForRead
                )

                # 不进入外部参照文件或外参块定义。
                if (
                    block.IsFromExternalReference
                    or block.IsFromOverlayReference
                ):
                    skipped_xref_definitions += 1
                    continue

                if block.IsLayout:
                    layout = transaction.GetObject(
                        block.LayoutId,
                        OpenMode.ForRead
                    )

                    if not layout.ModelType and not include_layouts:
                        continue

                    scope = (
                        "Model"
                        if layout.ModelType
                        else "Layout"
                    )
                    owner = str(layout.LayoutName)

                else:
                    if not include_blocks:
                        continue

                    scope = "BlockDefinition"
                    owner = str(block.Name)

            except Exception as ex:
                log(str(block_id.Handle), "读取块/布局", ex)
                continue

            for object_id in block:
                handle = str(object_id.Handle)

                if handle in seen_handles:
                    continue

                try:
                    obj = transaction.GetObject(
                        object_id,
                        OpenMode.ForRead
                    )

                    if not isinstance(obj, Entity):
                        continue

                    seen_handles.add(handle)
                    scanned += 1

                    row = {
                        "Handle": handle,
                        "Scope": scope,
                        "Owner": owner,
                        "Category": str(obj.GetType().Name),
                        "API Type": str(obj.GetType().FullName),
                        "Layer": plain(read(obj, "Layer", handle))
                    }

                    row["Name"] = plain(
                        first(
                            obj,
                            ["Name", "PointName"],
                            handle
                        )
                    )

                    if isinstance(obj, BlockReference):
                        row["Name"] = plain(
                            object_name(
                                transaction,
                                obj.BlockTableRecord,
                                handle
                            )
                        )

                    row["Style"] = plain(
                        object_name(
                            transaction,
                            read(obj, "StyleId", handle),
                            handle
                        )
                    )

                    row["Material"] = plain(
                        object_name(
                            transaction,
                            read(obj, "MaterialId", handle),
                            handle
                        )
                    )

                    row["Description"] = plain(
                        first(
                            obj,
                            [
                                "FullDescription",
                                "Description",
                                "RawDescription"
                            ],
                            handle
                        )
                    )

                    row["Easting"] = plain(
                        read(obj, "Easting", handle)
                    )

                    row["Northing"] = plain(
                        read(obj, "Northing", handle)
                    )

                    row["Elevation"] = plain(
                        read(obj, "Elevation", handle)
                    )

                    row["Point Elevation"] = None

                    if isinstance(obj, CogoPoint):
                        row["Point Elevation"] = row["Elevation"]

                    elif isinstance(obj, DBPoint):
                        row["Point Elevation"] = plain(obj.Position.Z)

                    row["Area"] = plain(
                        read(obj, "Area", handle)
                    )

                    row["Length"] = plain(
                        read(obj, "Length", handle)
                    )

                    # 对未公开Length属性的Curve，尝试读取累计长度。
                    if (
                        row["Length"] is None
                        and isinstance(obj, Curve)
                    ):
                        try:
                            row["Length"] = plain(
                                obj.GetDistanceAtParameter(obj.EndParam)
                                - obj.GetDistanceAtParameter(obj.StartParam)
                            )
                        except Exception as ex:
                            log(handle, "CurveLength", ex)

                    row["IsReferenceObject"] = plain(
                        read(obj, "IsReferenceObject", handle)
                    )

                    # 顶点默认值。
                    row["Vertex X"] = None
                    row["Vertex Y"] = None
                    row["Vertex Z"] = None
                    row["Vertex Count"] = None
                    row["Geometry Status"] = "Not processed"

                    try:
                        points, geometry_status = vertex_points(
                            obj,
                            transaction
                        )

                        row["Geometry Status"] = geometry_status
                        row["Vertex Count"] = len(points)

                        if points:
                            row["Vertex X"] = plain(points[0].X)
                            row["Vertex Y"] = plain(points[0].Y)
                            row["Vertex Z"] = plain(points[0].Z)

                        for index, point in enumerate(points, 1):
                            vertices.append([
                                handle,
                                scope,
                                owner,
                                index,
                                plain(point.X),
                                plain(point.Y),
                                plain(point.Z),
                                geometry_status
                            ])

                    except Exception as ex:
                        row["Geometry Status"] = "ERROR"
                        log(handle, "Vertices", ex)

                    # 读取已经附加到对象上的Property Sets。
                    row["Property Sets Status"] = "OK"
                    row["Property Set Count"] = None

                    try:
                        property_set_ids = list(
                            PropertyDataServices.GetPropertySets(obj)
                        )
                        row["Property Set Count"] = len(property_set_ids)

                    except Exception as ex:
                        property_set_ids = []

                        # 部分对象无属性集时可能返回eKeyNotFound。
                        if "eKeyNotFound" in str(ex):
                            row["Property Set Count"] = 0
                            row["Property Sets Status"] = (
                                "No attached Property Sets"
                            )
                        else:
                            row["Property Sets Status"] = "ERROR"
                            log(handle, "GetPropertySets", ex)

                    for property_set_id in property_set_ids:
                        try:
                            property_set = transaction.GetObject(
                                property_set_id,
                                OpenMode.ForRead
                            )

                            definition = transaction.GetObject(
                                property_set.PropertySetDefinition,
                                OpenMode.ForRead
                            )

                            set_name = str(definition.Name)
                            set_handle = str(property_set_id.Handle)

                            for parameter in definition.Definitions:
                                parameter_name = str(parameter.Name)
                                parameter_id = str(parameter.Id)

                                column_key = "PSET::{}::{}::{}".format(
                                    set_name,
                                    parameter_name,
                                    parameter_id
                                )

                                pset_columns.add(column_key)

                                value = None
                                status = "OK"

                                try:
                                    value = plain(
                                        property_set.GetAt(parameter.Id)
                                    )
                                except Exception as ex:
                                    status = "ERROR: " + str(ex)
                                    row["Property Sets Status"] = (
                                        "Partial errors"
                                    )
                                    log(handle, column_key, ex)

                                row[column_key] = value

                                properties.append([
                                    handle,
                                    scope,
                                    owner,
                                    set_handle,
                                    set_name,
                                    parameter_name,
                                    parameter_id,
                                    plain(
                                        read(
                                            parameter,
                                            "DataType",
                                            handle
                                        )
                                    ),
                                    value,
                                    status
                                ])

                        except Exception as ex:
                            row["Property Sets Status"] = "Partial errors"
                            log(handle, "PropertySet", ex)

                    # 不让.NET对象逃逸到事务之外。
                    records.append({
                        key: plain(value)
                        for key, value in row.items()
                    })

                except Exception as ex:
                    log(handle, "Entity", ex)

        # 只读事务，不调用Commit，不修改DWG。

    finally:
        try:
            if transaction is not None:
                transaction.Dispose()
        finally:
            document_lock.Dispose()

    STAGE = "组织Excel数据"

    base_headers = [
        "Handle",
        "Scope",
        "Owner",
        "Category",
        "API Type",
        "Name",
        "Layer",
        "Style",
        "Material",
        "Description",
        "Easting",
        "Northing",
        "Point Elevation",
        "Vertex X",
        "Vertex Y",
        "Vertex Z",
        "Elevation",
        "Area",
        "Length",
        "Vertex Count",
        "Geometry Status",
        "IsReferenceObject",
        "Property Set Count",
        "Property Sets Status"
    ]

    headers = base_headers + sorted(pset_columns)

    element_rows = [headers]

    for record in records:
        element_rows.append([
            record.get(header)
            for header in headers
        ])

    metadata_rows = [
        ["Item", "Value"],
        ["DWG", drawing_name],
        [
            "Exported",
            datetime.now().isoformat(timespec="seconds")
        ],
        ["Drawing insertion units", drawing_units],
        ["Include layouts", include_layouts],
        ["Include local block definitions", include_blocks],
        [
            "Coordinates",
            "WCS; block definitions use definition coordinates"
        ],
        ["Scanned entities", scanned],
        ["Exported entities", len(records)],
        ["Vertex rows", len(vertices)],
        ["Property parameter rows", len(properties)],
        ["Property parameter columns", len(pset_columns)],
        ["Log rows", len(LOG)],
        [
            "Skipped external-reference definitions",
            skipped_xref_definitions
        ],
        [
            "FeatureLine enum initialized",
            FeatureLinePointType is not None
        ],
        [
            "Category mapping",
            ".NET class name; not localized Properties palette category"
        ],
        [
            "Material mapping",
            "Assigned MaterialId; no ByLayer/ByBlock resolution"
        ],
        [
            "Vertex X/Y/Z in Elements",
            "First vertex only; all supported vertices in Vertices"
        ],
        [
            "Units",
            "Raw API values; no unit or coordinate-system conversion"
        ],
        [
            "Property Sets",
            "Existing attached sets only; no creation or forced update"
        ],
        [
            "Scope limitation",
            "Entities in selected spaces and optional local block definitions; "
            "no external DWG traversal or Civil internal geometry expansion"
        ]
    ]

    sheets = [
        (
            "Elements",
            element_rows
        ),
        (
            "Vertices",
            [[
                "Handle",
                "Scope",
                "Owner",
                "Vertex Index",
                "Vertex X",
                "Vertex Y",
                "Vertex Z",
                "Source"
            ]] + vertices
        ),
        (
            "PropertySets",
            [[
                "Handle",
                "Scope",
                "Owner",
                "PropertySet Handle",
                "PropertySet",
                "Parameter",
                "Parameter ID",
                "Data Type",
                "Value",
                "Status"
            ]] + properties
        ),
        (
            "Log",
            [[
                "Handle",
                "Stage",
                "Message"
            ]] + LOG
        ),
        (
            "Metadata",
            metadata_rows
        )
    ]

    STAGE = "写入XLSX"
    write_xlsx(path, sheets)

    STAGE = "完成"

    return {
        "Status": (
            "已导出"
            if not LOG
            else "已导出，请检查Log"
        ),
        "File": path,
        "ScannedEntities": scanned,
        "ExportedEntities": len(records),
        "VertexRows": len(vertices),
        "PropertyParameterRows": len(properties),
        "PropertyParameterColumns": len(pset_columns),
        "FeatureLineEnumReady": FeatureLinePointType is not None,
        "LogRows": len(LOG),
        "LogPreview": LOG[:20]
    }


# ============================================================
# Dynamo输出
# ============================================================

try:
    OUT = export()

except Exception:
    OUT = {
        "Status": "失败",
        "Stage": STAGE,
        "Error": traceback.format_exc(),
        "LogRows": len(LOG),
        "LogPreview": LOG[:20]
    }
# ----------------------------------------
watch = Watch(python_script)
