# Dynamo graph CorridorExtensions_AddStations.dyn (Dynamo 2.4.1.6394)
# packages: Civil3DToolkit 1.1.15

# group: Create Alignment
code_block = CodeBlock { "ADSK"; }
createAlignmentPlaceholder = Autodesk.Civil.DynamoNodes.AlignmentExtensions.CreateAlignmentPlaceholder(name=code_block)
byCoordinates = Point.ByCoordinates()
code_block_2 = CodeBlock { 150; }
byCoordinates_2 = Point.ByCoordinates(y=code_block_2)
addFixedLine = Autodesk.Civil.DynamoNodes.AlignmentEntitiesExtensions.AlignmentEntities.AddFixedLine(alignment=createAlignmentPlaceholder, start=byCoordinates, end=byCoordinates_2)
lastItem = List.LastItem(list=addFixedLine.SubEntities)
code_block_3 = CodeBlock { false; 200; 100; true; }
addFloatingCurve = Autodesk.Civil.DynamoNodes.AlignmentEntitiesExtensions.AlignmentEntities.AddFloatingCurve(alignment=addFixedLine.Alignment, subEnt=lastItem, next=code_block_3.out0, radius=code_block_3.out1, paramValue=code_block_3.out2, isClockwise=code_block_3.out3)
lastItem_2 = List.LastItem(list=addFloatingCurve.SubEntities)
addFloatingLine = Autodesk.Civil.DynamoNodes.AlignmentEntitiesExtensions.AlignmentEntities.AddFloatingLine(alignment=addFloatingCurve.Alignment, subEnt=lastItem_2, next=code_block_3.out0, length=code_block_3.out2)

# group: Create Profile
code_block_4 = CodeBlock { "Design"; }
addProfileByName = Autodesk.Civil.DynamoNodes.AlignmentExtensions.AddProfileByName(alignment=addFloatingLine.Alignment, profileName=code_block_4)
code_block_5 = CodeBlock { 0.0; 10; }
addPVI = Autodesk.Civil.DynamoNodes.ProfileExtensions.AddPVI(profile=addProfileByName, station=code_block_5.out0, elevation=code_block_5.out1)
code_block_6 = CodeBlock { 20; 20; }
code_block_7 = CodeBlock { 50; }
addPVIArc = Autodesk.Civil.DynamoNodes.ProfileExtensions.AddPVIArc(profile=addPVI.Profile, station=code_block_6.out0, elevation=code_block_6.out1, radius=code_block_7)
code_block_8 = CodeBlock { 350; 30; }
addPVI_2 = Autodesk.Civil.DynamoNodes.ProfileExtensions.AddPVI(profile=addPVIArc.Profile, station=code_block_8.out0, elevation=code_block_8.out1)
code_block_9 = CodeBlock { 100; 15; 10; 10; }
addPVIAsymParabola = Autodesk.Civil.DynamoNodes.ProfileExtensions.AddPVIAsymParabola(profile=addPVI_2.Profile, station=code_block_9.out0, elevation=code_block_9.out1, tanLen1=code_block_9.out2, tanLen2=code_block_9.out3)

# group: Create Profile View
alignment = Autodesk.Civil.DynamoNodes.Profile.Alignment(profile=addPVIAsymParabola.Profile)
code_block_10 = CodeBlock { 100; }
byCoordinates_3 = Point.ByCoordinates(x=code_block_10, y=code_block_10)
code_block_11 = CodeBlock { "ProfileView"; }
byAlignmentPointName = Autodesk.Civil.DynamoNodes.ProfileView.ByAlignmentPointName(alignment=alignment, insertPoint=byCoordinates_3, profileViewName=code_block_11)

code_block_12 = CodeBlock(a=addFloatingLine.Alignment) { a; }

# group: Create Assembly
code_block_13 = CodeBlock { "B"; 5; }
code_block_14 = CodeBlock { 30; }
byCoordinates_4 = Point.ByCoordinates(x=code_block_14)
byNamePoint = Autodesk.Civil.DynamoNodes.Assembly.ByNamePoint(name=code_block_13.out0, location=byCoordinates_4, assemblyType=code_block_13.out1)
code_block_15 = CodeBlock { "BasicLane"; "Subassembly.BasicLane"; ["LeftLane", "RightLane"]; }
code_block_16 = CodeBlock(a=byNamePoint, b=code_block_15.out0) { a; b; a?b:b; }
importStockSubassembly = Autodesk.Civil.DynamoNodes.Subassembly.ImportStockSubassembly(toolName=code_block_16.out2, className=code_block_15.out1, name=code_block_15.out2)
name = Autodesk.Civil.DynamoNodes.Subassembly.Name(subassembly=importStockSubassembly)
code_block_17 = CodeBlock { 0..1; }
addSubassembly = Autodesk.Civil.DynamoNodes.Assembly.AddSubassembly(assembly=code_block_16.a, subassemblyName=name, groupName=name, side=code_block_17)
name_2 = Autodesk.Civil.DynamoNodes.Assembly.Name(assembly=addSubassembly.Assembly)
firstItem = List.FirstItem(list=name_2)

# group: Create Corridor
code_block_18 = CodeBlock { "ADSK"; }
name_3 = Autodesk.Civil.DynamoNodes.CivilObject.Name(civilObject=code_block_12)
name_4 = Autodesk.Civil.DynamoNodes.CivilObject.Name(civilObject=addPVIAsymParabola.Profile)
byAlignmentProfileNames = Autodesk.Civil.DynamoNodes.CorridorExtensions.CorridorExtensions.ByAlignmentProfileNames(name=code_block_18, alignmentName=name_3, profileName=name_4)
baselines = Autodesk.Civil.DynamoNodes.Corridor.Baselines(corridor=byAlignmentProfileNames)
firstItem_2 = List.FirstItem(list=baselines)
code_block_19 = CodeBlock { "RG1"; }
startStation = Autodesk.Civil.DynamoNodes.Alignment.StartStation(alignment=code_block_12)
endStation = Autodesk.Civil.DynamoNodes.Alignment.EndStation(alignment=code_block_12)
code_block_20 = CodeBlock { true; }
addRegion = Autodesk.Civil.DynamoNodes.CorridorExtensions.CorridorExtensions.AddRegion(baseline=firstItem_2, name=code_block_19, assemblyName=firstItem, start=startStation, end=endStation, rebuild=code_block_20)

# group: Add Stations
code_block_21 = CodeBlock { 40; }
addStationToCorridor = Autodesk.Civil.DynamoNodes.CorridorExtensions.CorridorExtensions.AddStationToCorridor(corridor=byAlignmentProfileNames, rawstation=code_block_21)
code_block_22 = CodeBlock { 60; }
addStationToBaseline = Autodesk.Civil.DynamoNodes.CorridorExtensions.CorridorExtensions.AddStationToBaseline(baseline=firstItem_2, rawstation=code_block_22)
code_block_23 = CodeBlock { 140; }
addStationToRegion = Autodesk.Civil.DynamoNodes.CorridorExtensions.CorridorExtensions.AddStationToRegion(region=addRegion, rawstation=code_block_23)
getAdditionalStations = Autodesk.Civil.DynamoNodes.CorridorExtensions.CorridorExtensions.GetAdditionalStations(region=addStationToRegion)
