# Dynamo graph Drop Downs.dyn (Dynamo 2.4.1.6394)
# packages: Civil3DToolkit 1.1.10

current = Autodesk.AutoCAD.DynamoNodes.Document.Current()
surfaceByName = Autodesk.Civil.DynamoNodes.Selection.SurfaceByName(document=current)  # unwired: name
terrainStatistics = Autodesk.Civil.DynamoNodes.Surface.TerrainStatistics(surface=surfaceByName)
nrOfPoints = Watch(terrainStatistics.NumberOfPoints)  # graph output
nrOfTriangles = Watch(terrainStatistics.NumberOfTriangles)  # graph output
area_2d = Watch(terrainStatistics.Area2D)  # graph output
area_3d = Watch(terrainStatistics.Area3D)  # graph output
max_elevation = Watch(terrainStatistics.MaxElevation)  # graph output
min_elevation = Watch(terrainStatistics.MinElevation)  # graph output
max_grade = Watch(terrainStatistics.MaxGrade)  # graph output
min_grade = Watch(terrainStatistics.MinGrade)  # graph output
surfacesDD = SurfacesDropDown("Corridor - (1) Surface", document=current)
alignments = AlignmentNamesDropDown("ROAD1")
corridors = CorridorNameDropDown("Corridor - (1)")
surfaces = SurfaceNamesDropDown("EG")
