# Dynamo graph GIS_Update Properties.dyn (Dynamo 2.1.1.7865)

current = Autodesk.Civil.DynamoNodes.GIS.Map.Current()
layers = Autodesk.Civil.DynamoNodes.GIS.Map.Layers(map=current)
getFeaturesByTextFilter = Autodesk.Civil.DynamoNodes.GIS.MapLayer.GetFeaturesByTextFilter(mapLayer=layers)
properties = Autodesk.Civil.DynamoNodes.GIS.MapFeature.Properties(mapFeature=getFeaturesByTextFilter)
code_block = CodeBlock { "NetName"; "MyNetwork"; }
setPropertyValueByName = Autodesk.Civil.DynamoNodes.GIS.MapFeature.SetPropertyValueByName(mapFeature=getFeaturesByTextFilter, name=code_block.out0, value=code_block.out1)
