# Dynamo graph Site.dyn (Dynamo 2.4.1.6326)
# packages: Civil3DToolkit 1.0.2

current = Autodesk.AutoCAD.DynamoNodes.Document.Current()
getSites = Autodesk.Civil.DynamoNodes.LandDevelopment.Site.GetSites(document=current)
getParcels = Autodesk.Civil.DynamoNodes.LandDevelopment.Site.GetParcels(site=getSites)
getFeatureLines = Autodesk.Civil.DynamoNodes.LandDevelopment.Site.GetFeatureLines(site=getSites)
getAlignments = Autodesk.Civil.DynamoNodes.LandDevelopment.Site.GetAlignments(site=getSites)
