# Dynamo graph Object By Handle.dyn (Dynamo 2.4.1.6326)
# packages: Civil3DToolkit 1.0.0

current = Autodesk.AutoCAD.DynamoNodes.Document.Current()
code_block = CodeBlock { "6B65"; }
objectByHandle = Autodesk.AutoCAD.DynamoNodes.DocumentExtensions.ObjectByHandle(document=current, handle=code_block)
select_object = ObjectSelection()  # 1 picked in the model
objectHandle = Autodesk.AutoCAD.DynamoNodes.DocumentExtensions.ObjectHandle(item=select_object)
geometry = Autodesk.AutoCAD.DynamoNodes.Object.Geometry()  # unwired: object
python_script = Python(IN[0]=code_block)
# ---------- python_script.python (88 lines) ----------
"""
Copyright 2019 Autodesk, Inc. All rights reserved.

This file is part of the Civil 3D Python Module.

"""
__author__ = 'Paolo Emilio Serra - paolo.serra@autodesk.com'
__copyright__ = '2019'
__version__ = '1.0.0'

import clr

# Add Assemblies for AutoCAD and Civil 3D APIs
clr.AddReference('acmgd')
clr.AddReference('acdbmgd')
clr.AddReference('accoremgd')
clr.AddReference('AecBaseMgd')
clr.AddReference('AecPropDataMgd')
clr.AddReference('AeccDbMgd')
clr.AddReference('AeccPressurePipesMgd')
clr.AddReference('acdbmgdbrep')
clr.AddReference('System.Windows.Forms')
clr.AddReference('AutoCADNodes')

# Add standard Python references
import sys
sys.path.append('C:\Program Files (x86)\IronPython 2.7\Lib')
import os
import math

# Add references to manage arrays, collections and interact with the user
from System import *
from System.IO import *
from System.Collections.Specialized import *
from System.Windows.Forms import MessageBox

# Create an alias to the Autodesk.AutoCAD.ApplicationServices.Application class
import Autodesk.AutoCAD.ApplicationServices.Application as acapp

# Import references from AutoCAD
from Autodesk.AutoCAD.Runtime import *
from Autodesk.AutoCAD.ApplicationServices import *
from Autodesk.AutoCAD.EditorInput import *
from Autodesk.AutoCAD.DatabaseServices import *
from Autodesk.AutoCAD.Geometry import *

# Import references for PropertySets
from Autodesk.Aec.PropertyData import *
from Autodesk.Aec.PropertyData.DatabaseServices import *

# Import references for Civil 3D
from Autodesk.Civil.ApplicationServices import *
from Autodesk.Civil.DatabaseServices import *

from Autodesk.AutoCAD.DynamoNodes import *

adoc = acapp.DocumentManager.MdiActiveDocument
ed = adoc.Editor

# Example function
def my_function(handle):
	"""
	Description....
	:param first_param: ....
	:returns: ....
	"""
		
	global adoc
	
	output = None

	with adoc.LockDocument():
		with adoc.Database as db:
			with db.TransactionManager.StartTransaction() as t:
				bt = t.GetObject(db.BlockTableId, OpenMode.ForWrite)
				btr = t.GetObject(bt[BlockTableRecord.ModelSpace], OpenMode.ForWrite)
				
				oid = db.GetObjectId(False, Handle(int(handle, 16)), 0)
				
				dbo = t.GetObject(oid, OpenMode.ForWrite)
				
				output = str(oid)[1:-1] #Object.InternalMakeObject(dbo, False))

				t.Commit()
	return output
	
	
OUT = my_function(IN[0])
# ----------------------------------------
toNumber = String.ToNumber(str=python_script)
objectByObjectId = Autodesk.AutoCAD.DynamoNodes.DocumentExtensions.ObjectByObjectId(document=current, objectId=toNumber)
type = Object.Type(obj=python_script)
geometry_2 = Autodesk.AutoCAD.DynamoNodes.Object.Geometry(object=select_object)
type_2 = Object.Type(obj=toNumber)
