# Dynamo graph ObjectData in Block_Read.dyn (Dynamo 2.4.1.6394)
# packages: Civil3DToolkit 1.1.11

getOdTables = Autodesk.Civil.DynamoNodes.GIS.ObjectData.OdTable.GetOdTables()
current = Autodesk.AutoCAD.DynamoNodes.Document.Current()
code_block = CodeBlock { "ADSK"; }
blockByName = Autodesk.AutoCAD.DynamoNodes.Document.BlockByName(document=current, name=code_block)
objects = Autodesk.AutoCAD.DynamoNodes.Block.Objects(block=blockByName)
getObjectOdRecords = Autodesk.Civil.DynamoNodes.GIS.ObjectData.OdTable.GetObjectOdRecords(odTable=getOdTables, obj=objects)
getOdFields = Autodesk.Civil.DynamoNodes.GIS.ObjectData.OdTable.GetOdFields(odTable=getOdTables)
name = Autodesk.Civil.DynamoNodes.GIS.ObjectData.OdField.Name(odField=getOdFields)
getValueByName = Autodesk.Civil.DynamoNodes.GIS.ObjectData.OdRecord.GetValueByName(odRecord=getObjectOdRecords, name=name)
