# Dynamo graph COM API.dyn (Dynamo 2.4.1.6394)

python_script = Python()  # unwired: IN[0], IN[1]
# ---------- python_script.python (137 lines) ----------
"""
Copyright 2020 Autodesk, Inc. All rights reserved.

This file is part of the Civil 3D Python Module.

"""
__author__ = 'Paolo Emilio Serra - paolo.serra@autodesk.com'
__copyright__ = '2020'
__version__ = '1.0.0'

import clr

# Add Assemblies for AutoCAD and Civil 3D APIs
clr.AddReference('acmgd')
clr.AddReference('acdbmgd')
clr.AddReference('accoremgd')
clr.AddReference('AecBaseMgd')
clr.AddReference('AecPropDataMgd')
clr.AddReference('AeccDbMgd')
clr.AddReference('AeccPressurePipesMgd')
clr.AddReference('acdbmgdbrep')
clr.AddReference('System.Windows.Forms')
clr.AddReference('AutoCADNodes')
clr.AddReference('Civil3DNodes')
clr.AddReference('Autodesk.AECC.Interop.Land')

# Add standard Python references
import sys
sys.path.append('C:\Program Files (x86)\IronPython 2.7\Lib')
import os
import math

import logging
import tempfile

FORMAT = '[%(asctime)-15s] %(levelname)s: %(module)s.%(funcName)s %(message)s'
logging.basicConfig(filename=os.path.join(tempfile.gettempdir(), 'D4C3D.log'), level=logging.DEBUG,
                    format=FORMAT, datefmt='%Y/%m/%d %I:%M:%S')

# Add references to manage arrays, collections and interact with the user
from System import *
from System.IO import *
from System.Collections.Specialized import *
from System.Windows.Forms import MessageBox

# Create an alias to the Autodesk.AutoCAD.ApplicationServices.Application class
import Autodesk.AutoCAD.ApplicationServices.Application as acapp

# Import references from AutoCAD
from Autodesk.AutoCAD.Runtime import *
from Autodesk.AutoCAD.ApplicationServices import *
from Autodesk.AutoCAD.EditorInput import *
from Autodesk.AutoCAD.DatabaseServices import *
from Autodesk.AutoCAD.Geometry import *

# Import references for PropertySets
from Autodesk.Aec.PropertyData import *
from Autodesk.Aec.PropertyData.DatabaseServices import *

# Import references for Civil 3D
from Autodesk.Civil.ApplicationServices import *
from Autodesk.Civil.DatabaseServices import *

# Import AutoCAD and Civil 3D Dynamo Nodes
import Autodesk.AutoCAD.DynamoNodes as DA
import Autodesk.Civil.DynamoNodes as DC

from Autodesk.AECC.Interop.Land import *
from System.Reflection import *

adoc = acapp.DocumentManager.MdiActiveDocument
ed = adoc.Editor

# Example function
def my_function():
	"""
	Description....
	:param first_param: ....
	:returns: ....
	"""
		
	global adoc
	
	output = []
	ret = []

	with adoc.LockDocument():
		with adoc.Database as db:
			with db.TransactionManager.StartTransaction() as t:
				bt = t.GetObject(db.BlockTableId, OpenMode.ForWrite)
				btr = t.GetObject(bt[BlockTableRecord.ModelSpace], OpenMode.ForWrite)
				
				udps = []
				parcels = []
				done = False
				for oid in btr:
					obj = t.GetObject(oid, OpenMode.ForRead)
					if isinstance(obj, Parcel):
						parcel = obj.AcadObject
						parcels.append(parcel)
						if not done:
							comdb = parcel.Database
							udpcs = comdb.ParcelUserDefinedPropertyClassifications
							for udpc in udpcs:
								for udp in udpc.UserDefinedProperties:
									udps.append(udp)
							done = True
							a = clr.Reference[AeccUDPClassificationApplyWay]()
							props = obj.AcadObject.Parent.Parcels.Properties
							b = props.GetUserDefinedPropertyClassification(a)
							props.SetUserDefinedPropertyClassification(AeccUDPClassificationApplyWay.aeccUDPClassificationApplyAll, '')
						
						
						# return a.Value
				
				attr = []
				for parcel in parcels:
					temp = {'_'.join([udp.Classification.Name, udp.Name]): parcel.GetUserDefinedPropertyValue(udp.Name) for udp in udps}
					temp['Name'] = parcel.Name
					temp['Number'] = parcel.Number
					temp['Area'] = parcel.Statistics.Area
					temp['Perimeter'] = parcel.Statistics.Perimeter
					attr.append(temp)
					try:
						pass
						# [parcel.SetUserDefinedPropertyValue(udp, '1') for udp in udps if udp.Name == 'Test']
						
					except:
						pass
						
				return attr

				t.Commit()
	return output
	
	
OUT = my_function()
# ----------------------------------------
