# Dynamo graph Parcel User Defined Properties.dyn (Dynamo 2.4.1.6394)
# packages: Civil3DToolkit 1.0.18

current = Autodesk.AutoCAD.DynamoNodes.Document.Current()
getSites = Autodesk.Civil.DynamoNodes.LandDevelopment.Site.GetSites(document=current)
getParcels = Autodesk.Civil.DynamoNodes.LandDevelopment.Site.GetParcels(site=getSites)
code_block = CodeBlock { "Test"; }
getUserDefinedProperty = Autodesk.Civil.DynamoNodes.LandDevelopment.Parcel.GetUserDefinedProperty(parcel=getParcels, name=code_block)
