# Dynamo graph Parcels to Feature Lines.dyn (Dynamo 2.4.1.6394)
# packages: Civil3DToolkit 1.1.14

current = Autodesk.AutoCAD.DynamoNodes.Document.Current()
getSites = Autodesk.Civil.DynamoNodes.LandDevelopment.Site.GetSites(document=current)
getParcels = Autodesk.Civil.DynamoNodes.LandDevelopment.Site.GetParcels(site=getSites)
area = Autodesk.Civil.DynamoNodes.LandDevelopment.Parcel.Area(parcel=getParcels)
sortByKey = List.SortByKey(list=getParcels@L2, keys=area@L2)
code_block = CodeBlock { 22; }
dropItems = List.DropItems(list=sortByKey.sorted_list@L2, amount=code_block@L2)
number = Autodesk.Civil.DynamoNodes.LandDevelopment.Parcel.Number(parcel=dropItems)
string_from_object = FromObject(obj=number)
flatten = List.Flatten(list=string_from_object)
geometry = Autodesk.Civil.DynamoNodes.LandDevelopment.Parcel.Geometry(parcel=dropItems)
flatten_2 = List.Flatten(list=geometry)
byPolyCurve = Autodesk.Civil.DynamoNodes.LandDevelopment.FeatureLine.ByPolyCurve(name=flatten, curve=flatten_2)
