# Dynamo graph C3D_Map.dyn (Dynamo 2.1.1.7865)

current = Autodesk.AutoCAD.DynamoNodes.Document.Current()  # frozen
code_block = CodeBlock { "My Network"; }
byName = Autodesk.Civil.DynamoNodes.PipeNetworks.PipeNetwork.ByName(document=current, name=code_block)
pipe_network_parts_lists = PartsLists(document=current)
code_block_2 = CodeBlock(a=pipe_network_parts_lists) { a[0]; }
pipe_network_part_families = PartFamilies(partsList=code_block_2)
code_block_3 = CodeBlock(a=pipe_network_part_families.PartPipeFamily) { a[0]; }
pipe_network_part_sizes = PartSizes(partFamily=code_block_3)
code_block_4 = CodeBlock(a=pipe_network_part_sizes) { a[0]; }
python_script = Python()  # unwired: IN[0]
# ---------- python_script.python (169 lines) ----------
"""
Copyright 2019 Autodesk, Inc. All rights reserved.

This file is part of the Civil 3D Python Module.

"""
__author__ = 'Paolo Emilio Serra - paolo.serra@autodesk.com'
__copyright__ = '2019'
__version__ = '1.0.0'

import clr

# Add Assemblies for AutoCAD and Civil 3D APIs
clr.AddReference('acmgd')
clr.AddReference('acdbmgd')
clr.AddReference('accoremgd')
clr.AddReference('AecBaseMgd')
clr.AddReference('AecPropDataMgd')
clr.AddReference('AeccDbMgd')
clr.AddReference('AeccPressurePipesMgd')
clr.AddReference('acdbmgdbrep')
clr.AddReference('Autodesk.Map.Platform')
clr.AddReference('Autodesk.Map.Platform.Utils')
clr.AddReference('OSGeo.MapGuide.Foundation')
clr.AddReference('OSGeo.MapGuide.Geometry')
clr.AddReference('OSGeo.MapGuide.PlatformBase')
clr.AddReference('System.Windows.Forms')
clr.AddReference('ProtoGeometry')

# Add standard Python references
import sys
sys.path.append('C:\Program Files (x86)\IronPython 2.7\Lib')
import os
import math

# Add references to manage arrays, collections and interact with the user
from System import *
from System.IO import *
from System.Collections.Specialized import *
from System.Windows.Forms import MessageBox

# Create an alias to the Autodesk.AutoCAD.ApplicationServices.Application class
import Autodesk.AutoCAD.ApplicationServices.Application as acapp

# Import references from AutoCAD
from Autodesk.AutoCAD.Runtime import *
from Autodesk.AutoCAD.ApplicationServices import *
from Autodesk.AutoCAD.EditorInput import *
from Autodesk.AutoCAD.DatabaseServices import *
from Autodesk.AutoCAD.Geometry import *

# Import references for PropertySets
from Autodesk.Aec.PropertyData import *
from Autodesk.Aec.PropertyData.DatabaseServices import *

# Import references for Civil 3D
from Autodesk.Civil.ApplicationServices import *
from Autodesk.Civil.DatabaseServices import *

from Autodesk.Gis.Map.Platform import *
from Autodesk.Gis.Map.Platform.Utils import *
from OSGeo.MapGuide import *

from Autodesk.DesignScript.Geometry import *

adoc = acapp.DocumentManager.MdiActiveDocument
ed = adoc.Editor

# Example function
def my_function():
	"""
	Description....
	:param first_param: ....
	:returns: ....
	"""
		
	global adoc
	
	output = []

	with adoc.LockDocument():
		with adoc.Database as db:
			with db.TransactionManager.StartTransaction() as t:
				bt = t.GetObject(db.BlockTableId, OpenMode.ForWrite)
				btr = t.GetObject(bt[BlockTableRecord.ModelSpace], OpenMode.ForWrite)

				t.Commit()
	return output


map = AcMapMap.GetCurrentMap()

output = []
features = Features()
fqo = MgFeatureQueryOptions()
fqo.SetFilter('')

res_service = AcMapServiceFactory.GetService(MgServiceType.ResourceService)
fea_service = AcMapServiceFactory.GetService(MgServiceType.FeatureService)


if True:
	
	for l in map.GetLayers():
		if False:
			cd = l.GetClassDefinition()
			name = cd.GetName()
			iden = l.GetLayerDefinition()
			n = iden.GetRepositoryName()
			if False:
				try:
					res_id = MgResourceIdentifier(iden.RepositoryName)
				except:
					continue
		
				if res_service.ResourceExists(res_id):
					reader = res_service.GetResourceContent(res_id)
					sink = MgByteSink(reader)
					sink.ToFile(r'D:\test.xml')
			# bpc = MgBatchPropertyCollection()
			# reader = l.GetFeatures(bpc)
		
		reader = l.SelectFeatures(fqo)
		layer = []
		if True:
			while reader.ReadNext():
				temp = []
				for i in range(reader.GetPropertyCount()):
					try:
						pt = reader.GetPropertyType(i)
						temp.append(reader.GetPropertyName(i))
						if pt == 7:						
							temp.append(reader.GetInt32(i))
						elif pt == 5:
							temp.append(reader.GetDouble(i))
						elif pt == 9:
							temp.append(reader.GetString(i))
						elif pt == 13:
							geom = MgAgfReaderWriter().Read(reader.GetGeometry(i))
							if geom.GeometryType == 2:  # MgLineString
								start = geom.StartCoordinate
								end = geom.EndCoordinate
								sp = Point.ByCoordinates(start.X, start.Y)
								ep = Point.ByCoordinates(end.X, end.Y)
								temp.append(sp)
								temp.append(ep)
						try:
							b = reader.GetGeometry(i)
							sink = MgByteSink(b)
							if b is not None:
								temp.append(sink.ToFile(r'D:\test.xml'))
						except:
							pass
					except:
						pass
				layer.append(temp)
		output.append(layer)
		
		# output.append(dir(cd))
		# props = cd.GetProperties()
		# for prop in props:
		# 	output.append(dir(prop))
		# output.append(dir(l))
		# fsid = l.FeatureSourceId
		# output.append(reader)
		

	
OUT = output
# ----------------------------------------
transpose = List.Transpose(lists=python_script@L3)  # frozen
code_block_5 = CodeBlock(a=transpose) { ein = a[0][3]; eout = a[0][5]; start = a[0][9]; end = a[0][10]; diam = a[0][7]; }
translate = Geometry.Translate(geometry=code_block_5.start, zTranslation=code_block_5.ein)
translate_2 = Geometry.Translate(geometry=code_block_5.end, zTranslation=code_block_5.eout)
list_create = List.Create(item0=translate, item1=translate_2)
transpose_2 = List.Transpose(lists=list_create)
byBestFitThroughPoints = Line.ByBestFitThroughPoints(bestFitPoints=transpose_2)
code_block_6 = CodeBlock { false; }
addPipeByCurve = Autodesk.Civil.DynamoNodes.PipeNetworks.PipeNetwork.AddPipeByCurve(pipeNetwork=byName, partSize=code_block_4, curve=byBestFitThroughPoints, applyRules=code_block_6)
toNumber = String.ToNumber(str=code_block_5.diam)
setSizeByInnerDimension = Autodesk.Civil.DynamoNodes.PipeNetworks.Pipe.SetSizeByInnerDimension(pipe=addPipeByCurve, innerDimension=toNumber)
code_block_7 = CodeBlock(a=pipe_network_part_families.PartStructureFamily) { a[1]; }
pipe_network_part_sizes_2 = PartSizes(partFamily=code_block_7)
