# Dynamo graph PolylineExtensions_GetVertices.dyn (Dynamo 2.4.1.6394)
# packages: Civil3DToolkit 1.1.11

objects_types = AcObjectTypes("Polyline")
current = Autodesk.AutoCAD.DynamoNodes.Document.Current()
modelSpace = Autodesk.AutoCAD.DynamoNodes.Document.ModelSpace(document=current)
all_objects_of_type = AcObjectsOfType(type=objects_types, block=modelSpace)
getVertices = Autodesk.AutoCAD.DynamoNodes.PolylineExtensions.GetVertices(obj=all_objects_of_type)
flatten = List.Flatten(list=getVertices.Points)
code_block = CodeBlock { "a"; "ADSK"; "Consulting"; }
byGeometry = Autodesk.Civil.DynamoNodes.CogoPoint.ByGeometry(geometry=flatten, layer=code_block.out0, document=current)
byCogoPoints = Autodesk.Civil.DynamoNodes.CogoPointGroup.ByCogoPoints(cogoPoints=byGeometry, cogoPointGroupName=code_block.out1, document=current)
code_block_2 = CodeBlock(a=byCogoPoints, b=code_block.out1) { a?b:b; }
byCogoPointGroup = Autodesk.Civil.DynamoNodes.TinSurface.ByCogoPointGroup(cogoPointGroupName=code_block_2, surfaceName=code_block.out2, layer=code_block.out0, document=current)
