# Dynamo graph Civil3DToolkit.dyn (Dynamo 2.4.1.6394)
# packages: Civil3DToolkit 1.0.17

current = Autodesk.AutoCAD.DynamoNodes.Document.Current()

# group: Selection
string = StringInput("Fitting - (9)")
getFittingByName = FittingByName(document=current, name=string)
string_2 = StringInput("Pressure Pipe - (12)")
getPipeByName = PipeByName(document=current, name=string_2)
string_3 = StringInput("Appurtenance - (1)")
getAppurtenanceByName = AppurteananceByName(document=current, name=string_3)

# group: PressurePipeNetwork
pressurePipeNetworks = PressurePipeNetworks(document=current)
name = Autodesk.Civil.DynamoNodes.PressurePipeNetworks.PressurePipeNetwork.Name(pressurePipeNetwork=pressurePipeNetworks)
getPipesFittings = Autodesk.Civil.DynamoNodes.PressurePipeNetworks.PressurePipeNetwork.GetPipesFittings(pressurePipeNetwork=pressurePipeNetworks)

# group: PressureFitting
solid = Autodesk.Civil.DynamoNodes.PressurePipeNetworks.PressureFitting.Solid(pressureFitting=getPipesFittings.Fittings)
material = Autodesk.Civil.DynamoNodes.PressurePipeNetworks.PressureFitting.Material(pressureFitting=getPipesFittings.Fittings)
partDescription = Autodesk.Civil.DynamoNodes.PressurePipeNetworks.PressureFitting.PartDescription(pressureFitting=getPipesFittings.Fittings)
startPoint = Autodesk.Civil.DynamoNodes.PressurePipeNetworks.PressureFitting.StartPoint(pressureFitting=getPipesFittings.Fittings)
endPoint = Autodesk.Civil.DynamoNodes.PressurePipeNetworks.PressureFitting.EndPoint(pressureFitting=getPipesFittings.Fittings)
name_2 = Autodesk.Civil.DynamoNodes.PressurePipeNetworks.PressureFitting.Name(pressureFitting=getPipesFittings.Fittings)
pipeNetworkName = Autodesk.Civil.DynamoNodes.PressurePipeNetworks.PressureFitting.PipeNetworkName(pressureFitting=getPipesFittings.Fittings)
curves = Autodesk.Civil.DynamoNodes.PressurePipeNetworks.PressureFitting.Curves(pressureFitting=getPipesFittings.Fittings)

# group: PressurePipe
curve = Autodesk.Civil.DynamoNodes.PressurePipeNetworks.PressurePipe.Curve(pressurePipe=getPipesFittings.PressurePipes)
solid_2 = Autodesk.Civil.DynamoNodes.PressurePipeNetworks.PressurePipe.Solid(pressurePipe=getPipesFittings.PressurePipes)
endElevation = Autodesk.Civil.DynamoNodes.PressurePipeNetworks.PressurePipe.EndElevation(pressurePipe=getPipesFittings.PressurePipes)
endFitting = Autodesk.Civil.DynamoNodes.PressurePipeNetworks.PressurePipe.EndFitting(pressurePipe=getPipesFittings.PressurePipes)
endInvert = Autodesk.Civil.DynamoNodes.PressurePipeNetworks.PressurePipe.EndInvert(pressurePipe=getPipesFittings.PressurePipes)
endObvert = Autodesk.Civil.DynamoNodes.PressurePipeNetworks.PressurePipe.EndObvert(pressurePipe=getPipesFittings.PressurePipes)
endPoint_2 = Autodesk.Civil.DynamoNodes.PressurePipeNetworks.PressurePipe.EndPoint(pressurePipe=getPipesFittings.PressurePipes)
innerDiameter = Autodesk.Civil.DynamoNodes.PressurePipeNetworks.PressurePipe.InnerDiameter(pressurePipe=getPipesFittings.PressurePipes)
length2DCenterToCenter = Autodesk.Civil.DynamoNodes.PressurePipeNetworks.PressurePipe.Length2DCenterToCenter(pressurePipe=getPipesFittings.PressurePipes)
length3DCenterToCenter = Autodesk.Civil.DynamoNodes.PressurePipeNetworks.PressurePipe.Length3DCenterToCenter(pressurePipe=getPipesFittings.PressurePipes)
material_2 = Autodesk.Civil.DynamoNodes.PressurePipeNetworks.PressurePipe.Material(pressurePipe=getPipesFittings.PressurePipes)
midPoint = Autodesk.Civil.DynamoNodes.PressurePipeNetworks.PressurePipe.MidPoint(pressurePipe=getPipesFittings.PressurePipes)
name_3 = Autodesk.Civil.DynamoNodes.PressurePipeNetworks.PressurePipe.Name(pressurePipe=getPipesFittings.PressurePipes)
outerDiameter = Autodesk.Civil.DynamoNodes.PressurePipeNetworks.PressurePipe.OuterDiameter(pressurePipe=getPipesFittings.PressurePipes)
partDescription_2 = Autodesk.Civil.DynamoNodes.PressurePipeNetworks.PressurePipe.PartDescription(pressurePipe=getPipesFittings.PressurePipes)
pipeNetworkName_2 = Autodesk.Civil.DynamoNodes.PressurePipeNetworks.PressurePipe.PipeNetworkName(pressurePipe=getPipesFittings.PressurePipes)
radius = Autodesk.Civil.DynamoNodes.PressurePipeNetworks.PressurePipe.Radius(pressurePipe=getPipesFittings.PressurePipes)
slope = Autodesk.Civil.DynamoNodes.PressurePipeNetworks.PressurePipe.Slope(pressurePipe=getPipesFittings.PressurePipes)
startElevation = Autodesk.Civil.DynamoNodes.PressurePipeNetworks.PressurePipe.StartElevation(pressurePipe=getPipesFittings.PressurePipes)
startFitting = Autodesk.Civil.DynamoNodes.PressurePipeNetworks.PressurePipe.StartFitting(pressurePipe=getPipesFittings.PressurePipes)
startInvert = Autodesk.Civil.DynamoNodes.PressurePipeNetworks.PressurePipe.StartInvert(pressurePipe=getPipesFittings.PressurePipes)
startObvert = Autodesk.Civil.DynamoNodes.PressurePipeNetworks.PressurePipe.StartObvert(pressurePipe=getPipesFittings.PressurePipes)
startPoint_2 = Autodesk.Civil.DynamoNodes.PressurePipeNetworks.PressurePipe.StartPoint(pressurePipe=getPipesFittings.PressurePipes)
wallThickness = Autodesk.Civil.DynamoNodes.PressurePipeNetworks.PressurePipe.WallThickness(pressurePipe=getPipesFittings.PressurePipes)

# group: PressureAppurtenance
endPoint_3 = Autodesk.Civil.DynamoNodes.PressurePipeNetworks.PressureAppurtenance.EndPoint(pressureAppurtenance=getPipesFittings.Appurtenances)
material_3 = Autodesk.Civil.DynamoNodes.PressurePipeNetworks.PressureAppurtenance.Material(pressureAppurtenance=getPipesFittings.Appurtenances)
name_4 = Autodesk.Civil.DynamoNodes.PressurePipeNetworks.PressureAppurtenance.Name(pressureAppurtenance=getPipesFittings.Appurtenances)
pipeNetworkName_3 = Autodesk.Civil.DynamoNodes.PressurePipeNetworks.PressureAppurtenance.PipeNetworkName(pressureAppurtenance=getPipesFittings.Appurtenances)
partDescription_3 = Autodesk.Civil.DynamoNodes.PressurePipeNetworks.PressureAppurtenance.PartDescription(pressureAppurtenance=getPipesFittings.Appurtenances)
solid_3 = Autodesk.Civil.DynamoNodes.PressurePipeNetworks.PressureAppurtenance.Solid(pressureAppurtenance=getPipesFittings.Appurtenances)
startPoint_3 = Autodesk.Civil.DynamoNodes.PressurePipeNetworks.PressureAppurtenance.StartPoint(pressureAppurtenance=getPipesFittings.Appurtenances)
curves_2 = Autodesk.Civil.DynamoNodes.PressurePipeNetworks.PressureAppurtenance.Curves(pressureAppurtenance=getPipesFittings.Appurtenances)
