# Dynamo graph Pressure Pipe Networks.dyn (Dynamo 2.4.1.6394)

python_script = Python()  # unwired: IN[0]
# ---------- python_script.python (170 lines) ----------
"""
Copyright 2020 Autodesk, Inc. All rights reserved.

This file is part of the Civil 3D Python Module.

"""
__author__ = 'Paolo Emilio Serra - paolo.serra@autodesk.com'
__copyright__ = '2020'
__version__ = '1.0.0'

import clr

# Add Assemblies for AutoCAD and Civil 3D APIs
clr.AddReference('acmgd')
clr.AddReference('acdbmgd')
clr.AddReference('accoremgd')
clr.AddReference('AecBaseMgd')
clr.AddReference('AecPropDataMgd')
clr.AddReference('AeccDbMgd')
clr.AddReference('AeccPressurePipesMgd')
clr.AddReference('acdbmgdbrep')
clr.AddReference('System.Windows.Forms')
clr.AddReference('AutoCADNodes')
clr.AddReference('Civil3DNodes')
clr.AddReference('Autodesk.Civil3DToolkit')
clr.AddReference('ProtoGeometry')

# Add standard Python references
import sys
sys.path.append('C:\Program Files (x86)\IronPython 2.7\Lib')
import os
import math

import logging
import tempfile

FORMAT = '[%(asctime)-15s] %(levelname)s: %(module)s.%(funcName)s %(message)s'
logging.basicConfig(filename=os.path.join(tempfile.gettempdir(), 'D4C3D.log'), level=logging.DEBUG,
                    format=FORMAT, datefmt='%Y/%m/%d %I:%M:%S')

# Add references to manage arrays, collections and interact with the user
from System import *
from System.IO import *
from System.Collections.Specialized import *
from System.Windows.Forms import MessageBox

# Create an alias to the Autodesk.AutoCAD.ApplicationServices.Application class
import Autodesk.AutoCAD.ApplicationServices.Application as acapp

# Import references from AutoCAD
from Autodesk.AutoCAD.Runtime import *
from Autodesk.AutoCAD.ApplicationServices import *
from Autodesk.AutoCAD.EditorInput import *
from Autodesk.AutoCAD.DatabaseServices import *
from Autodesk.AutoCAD.Geometry import *

# Import references for PropertySets
from Autodesk.Aec.PropertyData import *
from Autodesk.Aec.PropertyData.DatabaseServices import *

# Import references for Civil 3D
from Autodesk.Civil.ApplicationServices import *
from Autodesk.Civil.DatabaseServices import *

# Import AutoCAD and Civil 3D Dynamo Nodes
import Autodesk.AutoCAD.DynamoNodes as DA
import Autodesk.Civil.DynamoNodes as DC

from Autodesk.Civil.DatabaseServices.Styles import *
import Autodesk.AutoCAD.DynamoNodes.GeometryConversion.AutoCADToDynamo as A2D
import Autodesk.DesignScript.Geometry as DG


adoc = acapp.DocumentManager.MdiActiveDocument
ed = adoc.Editor
cdoc = CivilApplication.ActiveDocument

# Example function
def my_function():
	"""
	Description....
	:param first_param: ....
	:returns: ....
	"""
		
	global adoc
	global cdoc
	
	output = []
	types = []

	with adoc.LockDocument():
		with adoc.Database as db:
			with db.TransactionManager.StartTransaction() as t:
				bt = t.GetObject(db.BlockTableId, OpenMode.ForWrite)
				btr = t.GetObject(bt[BlockTableRecord.ModelSpace], OpenMode.ForWrite)
				
				ppnids = CivilDocumentPressurePipesExtension.GetPressurePipeNetworkIds(cdoc)
				styleid = StylesRootPressurePipesExtension.GetPressurePipeStyles(cdoc.Styles)[0]
				style = t.GetObject(styleid, OpenMode.ForWrite)
				# style.GetDisplayStyleModel().Visible = True
				style.GetDisplayStylePlan(PressurePipeDisplayStylePlanType.Solid).Visible = True
				
				fstid = StylesRootPressurePipesExtension.GetPressureFittingStyles(cdoc.Styles)[0]
				fst = t.GetObject(fstid, OpenMode.ForWrite)
				fst.PlanOption.ViewOptions = PressureFittingPlanViewType.ModelBlock
				
				for ppnid in ppnids:
					ppn = t.GetObject(ppnid, OpenMode.ForWrite)
					for ppid in ppn.GetPipeIds():
						pp = t.GetObject(ppid, OpenMode.ForWrite)
						types.append(str(type(pp)))
						pp.StyleId = style.Id
						
						# if False:
						oids = DBObjectCollection()
						pp.Explode(oids)
						for obj in oids:
							# obj = t.GetObject(oid, OpenMode.ForRead)
							temp = []
							b = t.GetObject(obj.BlockTableRecord, OpenMode.ForRead)
							for oid in b:
								item = t.GetObject(oid, OpenMode.ForRead)
								if isinstance(item, Solid3d):
									temp.append(A2D.ToSolid(item))
							output.append(temp)
					for ppid in ppn.GetFittingIds():
						# try:
						pp = t.GetObject(ppid, OpenMode.ForWrite)
						types.append(str(type(pp)))
						# pp.StyleId = fst.Id
						# curve = pp.BaseCurve
						# fd = curve.GetFirstDerivative(pp.StartPoint)
						# sd = curve.GetFirstDerivative(pp.EndPoint)
						# cs = DG.CoordinateSystem.ByOriginVectors(A2D.ToPoint(pp.Position))
						#cs = A2D.ToCoordinateSystem(pp.CompoundObjectTransform)
						# if False:
						oids = DBObjectCollection()
						pp.Explode(oids)
						for obj in oids:
							# obj = t.GetObject(oid, OpenMode.ForRead)
							temp = []
							b = t.GetObject(obj.BlockTableRecord, OpenMode.ForRead)
							
							for oid in b:
								item = t.GetObject(oid, OpenMode.ForRead)
								cs = A2D.ToCoordinateSystem(item.BlockTransform)
								if isinstance(item, BlockReference):
									m = t.GetObject(item.BlockTableRecord, OpenMode.ForRead)
									
									for moid in m:
										g = t.GetObject(moid, OpenMode.ForRead)
										if isinstance(g, Solid3d):
											try:
												temp.append(A2D.ToSolid(g).Transform(cs).Translate(A2D.ToPoint(pp.Location).AsVector()))
											except:
												pass
										
										# if isinstance(g, Solid3d):
										#	temp.append(g)
							output.append(temp) 
						# cs.Dispose() 
						# except Exception as ex:
						# 	output.append(ex.message, ex.ex_info)

				# t.Commit()
	return output  # , types
	
	
OUT = my_function()   
# ----------------------------------------
