# Dynamo graph Profile Name.dyn (Dynamo 2.4.1.6394)

current = Autodesk.AutoCAD.DynamoNodes.Document.Current()
alignments = Alignments(document=current)
profiles = Autodesk.Civil.DynamoNodes.Alignment.Profiles(alignment=alignments)
name = Autodesk.Civil.DynamoNodes.CivilObject.Name(civilObject=profiles)
