# Dynamo graph SIGN_Place_Cooridor_CSV_Glenwood_EB.dyn (Dynamo 2.1.1.7865)

string = StringInput("D:\PROJECTS\Dynamo\ROAD\EB_SIGN_INV_ROAD.csv")
boolean = BoolSelector(true)

# group: Read CSV file
importCSV = Data.ImportCSV(filePath=string, transpose=boolean)

# group: Calculate insertion point for block
code_block = CodeBlock { 1; }
getItemAtIndex = List.GetItemAtIndex(list=importCSV, index=code_block, lacing=CrossProduct)
code_block_2 = CodeBlock { 0; }
getItemAtIndex_2 = List.GetItemAtIndex(list=importCSV, index=code_block_2, lacing=CrossProduct)

byCoordinates = Point.ByCoordinates(x=getItemAtIndex)
string_2 = StringInput("EB CORRIDOR")
string_3 = StringInput("BL - 57")

# group: Get Baseline
current = Autodesk.AutoCAD.DynamoNodes.Document.Current()
corridorByName = Autodesk.Civil.DynamoNodes.Selection.CorridorByName(name=string_2, document=current)
baselineByName = Autodesk.Civil.DynamoNodes.Corridor.BaselineByName(corridor=corridorByName, name=string_3)

coordinateSystemByStation = Autodesk.Civil.DynamoNodes.Baseline.CoordinateSystemByStation(baseline=baselineByName, station=getItemAtIndex_2)
transform = Geometry.Transform(geometry=byCoordinates, cs=coordinateSystemByStation)

# group (continued): Calculate insertion point for block
XAxis = CoordinateSystem.XAxis(coordinateSystem=coordinateSystemByStation)

# group: Calculate rotation
X = Vector.X(vector=XAxis)
Y = Vector.Y(vector=XAxis)
code_block_3 = CodeBlock(o=X, a=Y) { o; a; Math.Atan(o/-a)-90; }

string_4 = StringInput("ROAD_SIGN")
modelSpace = Autodesk.AutoCAD.DynamoNodes.Document.ModelSpace(document=current)

# group: Insert block reference
code_block_4 = CodeBlock { 2; }
getItemAtIndex_3 = List.GetItemAtIndex(list=importCSV, index=code_block_4, lacing=CrossProduct)
blockByName = Autodesk.AutoCAD.DynamoNodes.Document.BlockByName(document=current, name=getItemAtIndex_3, lacing=CrossProduct)
create = Autodesk.AutoCAD.DynamoNodes.BlockReference.Create(sourceBlock=blockByName, position=transform, rotationDegrees=code_block_3.out2, layer=string_4, block=modelSpace)
