# Dynamo graph TKCorridorFeatureLines.dyn (Dynamo 2.4.1.6394)
# packages: Civil3DToolkit 1.1.7

current = Autodesk.AutoCAD.DynamoNodes.Document.Current()
corridors = Corridors(document=current)
baselines = Autodesk.Civil.DynamoNodes.Corridor.Baselines(corridor=corridors)
codes = Autodesk.Civil.DynamoNodes.Baseline.Codes(baseline=baselines)
getTkFeatureLinesByCode = Autodesk.Civil.DynamoNodes.CorridorExtensions.CorridorExtensions.GetTkFeatureLinesByCode(baseline=baselines, code=codes.Point_Codes)
points = Autodesk.Civil.DynamoNodes.CorridorExtensions.TkCorridorFeatureLine.Points(tkCorridorFeatureLine=getTkFeatureLinesByCode)  # frozen
exportAsPolylines = Autodesk.Civil.DynamoNodes.CorridorExtensions.TkCorridorFeatureLine.ExportAsPolylines(tkCorridorFeatureLine=getTkFeatureLinesByCode)  # frozen
polyCurve = Autodesk.Civil.DynamoNodes.CorridorExtensions.TkCorridorFeatureLine.PolyCurve(tkCorridorFeatureLine=getTkFeatureLinesByCode)  # frozen
startStation = Autodesk.Civil.DynamoNodes.CorridorExtensions.TkCorridorFeatureLine.StartStation(tkCorridorFeatureLine=getTkFeatureLinesByCode)
endStation = Autodesk.Civil.DynamoNodes.CorridorExtensions.TkCorridorFeatureLine.EndStation(tkCorridorFeatureLine=getTkFeatureLinesByCode)
code_block = CodeBlock(s=startStation, e=endStation) { (s + e) / 2; }
coordinateSystemByStation = Autodesk.Civil.DynamoNodes.CorridorExtensions.TkCorridorFeatureLine.CoordinateSystemByStation(tkCorridorFeatureLine=getTkFeatureLinesByCode, station=code_block)  # frozen
offsetElevationByStation = Autodesk.Civil.DynamoNodes.CorridorExtensions.TkCorridorFeatureLine.OffsetElevationByStation(tkCorridorFeatureLine=getTkFeatureLinesByCode, station=code_block)  # frozen
code_block_2 = CodeBlock { "FL"; }
current_2 = Autodesk.AutoCAD.DynamoNodes.Document.Current()
code_block_3 = CodeBlock { "0"; }
layerByName = Autodesk.AutoCAD.DynamoNodes.Document.LayerByName(document=current_2, name=code_block_3)
getSites = Autodesk.Civil.DynamoNodes.LandDevelopment.Site.GetSites(document=current_2)
code_block_4 = CodeBlock(a=getSites) { a[0]; }
exportAsGradingFeatureLine = Autodesk.Civil.DynamoNodes.CorridorExtensions.TkCorridorFeatureLine.ExportAsGradingFeatureLine(tkCorridorFeatureLine=getTkFeatureLinesByCode, featurelineName=code_block_2, layer=layerByName, site=code_block_4)  # frozen
code_block_5 = CodeBlock { "AL"; "PR"; }
alignment_types = AlignmentTypesDropDown("Offset")
exportAsAlignment = Autodesk.Civil.DynamoNodes.CorridorExtensions.TkCorridorFeatureLine.ExportAsAlignment(tkCorridorFeatureLine=getTkFeatureLinesByCode, alignmentName=code_block_5.out0, layer=layerByName, site=code_block_4, alignmentType=alignment_types)  # frozen
code_block_6 = CodeBlock(a=getTkFeatureLinesByCode) { a[0][0][0]; }
alignmentByName = Autodesk.Civil.DynamoNodes.Selection.AlignmentByName(name=code_block_5.out0, document=current_2)
exportAsProfile = Autodesk.Civil.DynamoNodes.CorridorExtensions.TkCorridorFeatureLine.ExportAsProfile(tkCorridorFeatureLine=code_block_6, profileName=code_block_5.out1, alignment=alignmentByName, layer=layerByName)
code_block_7 = CodeBlock {  }
