# Dynamo graph ASSIGN CENTROID VALUE 1.dyn "ASSIGN CENTROID VALUE" (Dynamo 2.13.1.3887)

# group: Assign Centroid to a Particular Property Def
property_definition_name = StringInput("FILE")
property_name = StringInput("CENTROID")
python_script = Python(IN[0]=property_definition_name, IN[1]=property_name)  # IronPython2
# ---------- python_script.python (73 lines) ----------
# Load the Python Standard and DesignScript Libraries
import sys
import clr

# Add Assemblies for AutoCAD and Civil3D
clr.AddReference('AcMgd')
clr.AddReference('AcCoreMgd')
clr.AddReference('AcDbMgd')
clr.AddReference('AecBaseMgd')
clr.AddReference('AecPropDataMgd')
clr.AddReference('AeccDbMgd')

# Import references from AutoCAD
from Autodesk.AutoCAD.Runtime import *
from Autodesk.AutoCAD.ApplicationServices import *
from Autodesk.AutoCAD.EditorInput import *
from Autodesk.AutoCAD.DatabaseServices import *
from Autodesk.AutoCAD.Geometry import *

# Import references from Civil3D
from Autodesk.Civil.ApplicationServices import *
from Autodesk.Civil.DatabaseServices import *
from System.Collections.Generic import List
from Autodesk.Aec.PropertyData.DatabaseServices import PropertyDataServices
from System import Array 

#DEVELOPED BY MD

# The inputs to this node will be stored as a list in the IN variables.
extracted_info = []
test_extracted_info = []
CENTROIDS = []

PROPERTY_SET_DEF_NAME = IN[0]
PROPERTY_SET_NAME = IN[1]

adoc = Application.DocumentManager.MdiActiveDocument
editor = adoc.Editor

with adoc.LockDocument():
    with adoc.Database as db:

        with db.TransactionManager.StartTransaction() as trans:
            # Access the Block Table Record for the Model Space(This is mainly to get access of the Model Space Contents)
            bt = trans.GetObject(db.BlockTableId, OpenMode.ForWrite)
            btr = trans.GetObject(bt[BlockTableRecord.ModelSpace], OpenMode.ForWrite)
            
    
            # Iterate through all objects in the Model Space
            for objId in btr:
            	# Grabs Each Object By Taking in objId as argument
                obj = trans.GetObject(objId, OpenMode.ForWrite)
             	# Retrieve ALL property set definitions used by the object
             	if isinstance(obj, Solid3d):
             		centroid_X = format(obj.MassProperties.Centroid.X, ".3f")
             		centroid_Y = format(obj.MassProperties.Centroid.Y, ".3f")
             		centroid_Z = format(obj.MassProperties.Centroid.Z, ".3f")
             		centroid = "X: {0}, Y: {1}, Z: {2}".format(centroid_X, centroid_Y, centroid_Z)
             		
             		psDefsUsed = PropertyDataServices.GetPropertySets(obj)
             		for psDefId in psDefsUsed:
             			psDef = trans.GetObject(psDefId, OpenMode.ForWrite)
             			if psDef.PropertySetDefinitionName == PROPERTY_SET_DEF_NAME:
             				id = psDef.PropertyNameToId(PROPERTY_SET_NAME)
             				psDef.SetAt(id,centroid)
             					
             				
            # Commit before end transaction
            trans.Commit()
            pass

# Assign your output to the OUT variable.
OUT =0
# ----------------------------------------
