# Dynamo graph LAT_LONG_Automation_V1.1.dyn "COORDINATE_Automation_V1.1" (Dynamo 2.13.1.3887)

current = Autodesk.AutoCAD.DynamoNodes.Document.Current()
list_of_all_the_layers = Autodesk.AutoCAD.DynamoNodes.Document.Layers(document=current)
watch = Watch(list_of_all_the_layers)

# group: PLEASE ENTER THE DESIRED LAYER(S) INDEX
enter_the_index_number_of = CodeBlock { [1,2]; }  # "Enter the index number of Desired Layers For UNION"

list_of_the_selected_layers = List.GetItemAtIndex(list=list_of_all_the_layers, index=enter_the_index_number_of)
current_2 = Autodesk.AutoCAD.DynamoNodes.Document.Current()
modelSpace = Autodesk.AutoCAD.DynamoNodes.Document.ModelSpace(document=current_2)
all_objects_on_layer = AcObjectsOnLayer(layer=list_of_the_selected_layers, block=modelSpace)
watch_2 = Watch(all_objects_on_layer)
convert_to_object_id = Python(IN[0]=all_objects_on_layer)  # IronPython2
# ---------- convert_to_object_id.python (48 lines) ----------
# Load the Python Standard and DesignScript Libraries
import sys
import clr

# Add Assemblies for AutoCAD and Civil3D
clr.AddReference('AcMgd')
clr.AddReference('AcCoreMgd')
clr.AddReference('AcDbMgd')
clr.AddReference('AecBaseMgd')
clr.AddReference('AecPropDataMgd')
clr.AddReference('AeccDbMgd')

# Import references from AutoCAD
from Autodesk.AutoCAD.Runtime import *
from Autodesk.AutoCAD.ApplicationServices import *
from Autodesk.AutoCAD.EditorInput import *
from Autodesk.AutoCAD.DatabaseServices import *
from Autodesk.AutoCAD.Geometry import *

# Import references from Civil3D
from Autodesk.Civil.ApplicationServices import *
from Autodesk.Civil.DatabaseServices import *

# The inputs to this node will be stored as a list in the IN variables.
union_objects_list = IN[0]
union_objects_list_ids = []

for obj_list in union_objects_list:
	for obj in obj_list:
		union_objects_list_ids.append(obj.InternalObjectId)

adoc = Application.DocumentManager.MdiActiveDocument
editor = adoc.Editor

with adoc.LockDocument():
    with adoc.Database as db:

        with db.TransactionManager.StartTransaction() as t:
            # Place your code below
            # 
            #

            # Commit before end transaction
            #t.Commit()
            pass

# Assign your output to the OUT variable.
OUT = union_objects_list_ids
# ----------------------------------------
watch_3 = Watch(convert_to_object_id)

# group: Python Interpreter Directory
python_interpreter_path = Filename("..\..\..\..\..\Users\Md.Neloy\AppData\Local\Programs\Python\Python311\python.exe")

# group: PyProjFile
# Main Python FIle For the Conversion
pyproj_file_path = Filename(".\ConversionPyProj.py")

# group: MAPPING SYSTEM
epsg_code_eg_28356_for_gda_94 = StringInput("28356")  # "EPSG CODE. eg. "28356" for GDA 94/MGA 56"

extract_coordinate_of_the = Python(IN[0]=convert_to_object_id, IN[1]=python_interpreter_path, IN[2]=pyproj_file_path, IN[3]=epsg_code_eg_28356_for_gda_94)  # "EXTRACT COORDINATE OF THE CENTROID"; IronPython2
# ---------- extract_coordinate_of_the.python (65 lines) ----------
import clr
import subprocess
import json

clr.AddReference('AcMgd')
clr.AddReference('AcCoreMgd')
clr.AddReference('AcDbMgd')
clr.AddReference('AecBaseMgd')
clr.AddReference('AecPropDataMgd')
clr.AddReference('AeccDbMgd')

from Autodesk.AutoCAD.Runtime import *
from Autodesk.AutoCAD.ApplicationServices import Application
from Autodesk.AutoCAD.DatabaseServices import *
from Autodesk.AutoCAD.EditorInput import *
from Autodesk.AutoCAD.Geometry import *
from Autodesk.Civil.ApplicationServices import *
from Autodesk.Civil.DatabaseServices import *

union_objects_list_ids = IN[0]
Python_Interpreter_Path = IN[1]
PyProjPath = IN[2]
epsg_code = IN[3]

adoc = Application.DocumentManager.MdiActiveDocument
editor = adoc.Editor

easting_list = []
northing_list = []
object_id_list = []

with adoc.LockDocument():
    with adoc.Database as db:
        with db.TransactionManager.StartTransaction() as trans:
            bt = trans.GetObject(db.BlockTableId, OpenMode.ForWrite)
            btr = trans.GetObject(bt[BlockTableRecord.ModelSpace], OpenMode.ForWrite)
            all_solids = list(union_objects_list_ids)

            if all_solids:
                for solid_id in all_solids:
                    solid = trans.GetObject(solid_id, OpenMode.ForWrite)
                    if isinstance(solid, Solid3d):
                        centroid_absoluteCoordinates = solid.MassProperties.Centroid
                        easting_list.append(centroid_absoluteCoordinates.X)
                        northing_list.append(centroid_absoluteCoordinates.Y)
                        object_id_list.append(str(solid_id))

            trans.Commit()

# Convert the easting, northing, and object ID lists to JSON strings for passing as command-line arguments
easting_json = json.dumps(easting_list)
northing_json = json.dumps(northing_list)
object_id_json = json.dumps(object_id_list)

# Run the external Python script and capture the output
result = subprocess.Popen([Python_Interpreter_Path, PyProjPath, easting_json, northing_json, object_id_json, epsg_code], stdout=subprocess.PIPE, stderr=subprocess.PIPE)
stdout, stderr = result.communicate()
result.wait()

# Check for errors in the stderr
# Parse the JSON output from the external script
output_json = stdout.decode('utf-8')
results = json.loads(output_json)

OUT = results
# ----------------------------------------
watch_4 = Watch(extract_coordinate_of_the)
watch_5 = Watch(list_of_the_selected_layers)

# group: PROPERTYSET INFO
property_set_name = StringInput("TfNSW_Asset")
property_name = StringInput("TfNSW_GPSCoordinates")

assign_to_property_set = Python(IN[0]=extract_coordinate_of_the, IN[1]=property_set_name, IN[2]=property_name)  # IronPython2
# ---------- assign_to_property_set.python (62 lines) ----------
# Load the Python Standard and DesignScript Libraries
import sys
import clr

# Add Assemblies for AutoCAD and Civil3D
clr.AddReference('AcMgd')
clr.AddReference('AcCoreMgd')
clr.AddReference('AcDbMgd')
clr.AddReference('AecBaseMgd')
clr.AddReference('AecPropDataMgd')
clr.AddReference('AeccDbMgd')

# Import references from AutoCAD
from Autodesk.AutoCAD.Runtime import *
from Autodesk.AutoCAD.ApplicationServices import *
from Autodesk.AutoCAD.EditorInput import *
from Autodesk.AutoCAD.DatabaseServices import *
from Autodesk.AutoCAD.Geometry import *

# Import references from Civil3D
# Import references from Civil3D
from Autodesk.Civil.ApplicationServices import *
from Autodesk.Civil.DatabaseServices import *
from System.Collections.Generic import List
from Autodesk.Aec.PropertyData.DatabaseServices import PropertyDataServices
from System import Array, Convert
# The inputs to this node will be stored as a list in the IN variables.
id_lat_long = IN[0]
PROPERTY_SET_DEF_NAME = IN[1]
PROPERTY_SET_NAME = IN[2]
lat_lon_list = []

adoc = Application.DocumentManager.MdiActiveDocument
editor = adoc.Editor

with adoc.LockDocument():
    with adoc.Database as db:

        with db.TransactionManager.StartTransaction() as trans:
        	bt = trans.GetObject(db.BlockTableId, OpenMode.ForWrite)
        	btr = trans.GetObject(bt[BlockTableRecord.ModelSpace], OpenMode.ForWrite)
        	
        	for objId in btr:
        		obj = trans.GetObject(objId, OpenMode.ForWrite)
        		obj_id_str_actual = objId.ToString()
        		
        		for obj_id_str, latitude, longitude in id_lat_long:
        			if obj_id_str == obj_id_str_actual:
        				lat_lon_str = "{},{}".format(latitude, longitude)
        				psDefsUsed = PropertyDataServices.GetPropertySets(obj)
        				for psDefId in psDefsUsed:
        					psDef = trans.GetObject(psDefId, OpenMode.ForWrite)
        					if psDef.PropertySetDefinitionName == PROPERTY_SET_DEF_NAME:
        						id = psDef.PropertyNameToId(PROPERTY_SET_NAME)
        						psDef.SetAt(id,lat_lon_str)
        						lat_lon_list.append(lat_lon_str)
        			
        	trans.Commit()
        	pass

# Assign your output to the OUT variable.
OUT = lat_lon_list
# ----------------------------------------
watch_6 = Watch(assign_to_property_set)
