# Dynamo graph LAYER__ITEM_NUMBER_FIELDS 1.dyn "LAYER__ITEM_NUMBER_FIELDS" (Dynamo 2.13.1.3887)

# group: Assigning Field to Item-->Number (Objects By Layers)
# Grabs Objects By LayerName and Assigns Value to Them Using User Defined Number
layerName = StringInput("V-NODE")
userDefinedNumber = StringInput("000061")
assign_to_item_number = Python(IN[0]=layerName, IN[1]=userDefinedNumber)  # IronPython2
# ---------- assign_to_item_number.python (100 lines) ----------
# Load the Python Standard and DesignScript Libraries
import sys
import clr

# Add Assemblies for AutoCAD and Civil3D
clr.AddReference('AcMgd')
clr.AddReference('AcCoreMgd')
clr.AddReference('AcDbMgd')
clr.AddReference('AecBaseMgd')
clr.AddReference('AecPropDataMgd')
clr.AddReference('AeccDbMgd')

# Import references from AutoCAD
from Autodesk.AutoCAD.Runtime import *
from Autodesk.AutoCAD.ApplicationServices import *
from Autodesk.AutoCAD.EditorInput import *
from Autodesk.AutoCAD.DatabaseServices import *
from Autodesk.AutoCAD.Geometry import *

# Import references from Civil3D
from Autodesk.Civil.ApplicationServices import *
from Autodesk.Civil.DatabaseServices import *
from System.Collections.Generic import List
from Autodesk.Aec.PropertyData.DatabaseServices import PropertyDataServices

#DEVELOPED BY MD

# The inputs to this node will be stored as a list in the IN variables.
extracted_info = []
test_extracted_info = []

userValue = IN[0]
userLayer = IN[1]

adoc = Application.DocumentManager.MdiActiveDocument
editor = adoc.Editor

with adoc.LockDocument():
    with adoc.Database as db:

        with db.TransactionManager.StartTransaction() as trans:
            # Access the Block Table Record for the Model Space(This is mainly to get access of the Model Space Contents)
            bt = trans.GetObject(db.BlockTableId, OpenMode.ForWrite)
            btr = trans.GetObject(bt[BlockTableRecord.ModelSpace], OpenMode.ForWrite)
    
            # Iterate through all objects in the Model Space
            for objId in btr:
            	# Grabs Each Object By Taking in objId as argument
                obj = trans.GetObject(objId, OpenMode.ForWrite)
                #checks if the object layer is matched with the layer user defined
                if obj.Layer == userLayer:
                 	# Retrieve ALL property set definitions used by the object
                    psDefsUsed = PropertyDataServices.GetPropertySets(obj)
                    # Check if the "Item" Property Set Definition is used by the object
                    for psDefId in psDefsUsed:
                        psDef = trans.GetObject(psDefId, OpenMode.ForWrite)
                        if psDef.PropertySetDefinitionName == "Item":
                        	id = psDef.PropertyNameToId("Number")
                        	value = psDef.GetAt(id)
                        	if value is None or value == "":
                        		savedValue = 0
                        	else:
                        		extracted_info.append(value)
    			
			if extracted_info:		
				arrayValue = extracted_info[-1]	
			
			# Iterate through all objects in the Model Space
            for objId in btr:
            	# Grabs Each Object By Taking in objId as argument
                obj = trans.GetObject(objId, OpenMode.ForWrite)
                #checks if the object layer is matched with the layer user defined
                if obj.Layer == userLayer:
                 	# Retrieve ALL property set definitions used by the object
                    psDefsUsed = PropertyDataServices.GetPropertySets(obj)
                    # Check if the "Item" Property Set Definition is used by the object
                    for psDefId in psDefsUsed:
                        psDef = trans.GetObject(psDefId, OpenMode.ForWrite)
                        if psDef.PropertySetDefinitionName == "Item":
                        	id = psDef.PropertyNameToId("Number")
                        	value = psDef.GetAt(id)
                        	test_extracted_info.append(value)
                        	if value is None or value == "":
                        		if not extracted_info:
                        			psDef.SetAt(id,userValue)
                        			userValue_int = int(userValue)+1
                        			userValue = str(userValue_int).zfill(len(userValue))	
                        		else:
                					while arrayValue in extracted_info:
                						arrayValue_int = int(arrayValue)+1
                						arrayValue = str(arrayValue_int).zfill(len(arrayValue))
                					psDef.SetAt(id,arrayValue)
                					extracted_info.append(arrayValue)
	                			
            # Commit before end transaction
            trans.Commit()
            pass

# Assign your output to the OUT variable.
OUT = test_extracted_info
# ----------------------------------------

watch = Watch(assign_to_item_number)
