# Dynamo graph Project_Data_Import_from_csv.dyn "Project_Data_Import 4" (Dynamo 2.13.1.3887)

# group: Import Excel Property set
file_path = Filename(".\DATA_EXPORT.csv")

boolean = BoolSelector(false)
extract_all_columns = Data.ImportCSV(filePath=file_path, transpose=boolean)
extract_3rd_column_object_number = Python(IN[0]=extract_all_columns)  # CPython3
# ---------- extract_3rd_column_object_number.python (43 lines) ----------
# Load the Python Standard and DesignScript Libraries
import sys
import clr

# Add Assemblies for AutoCAD and Civil3D
clr.AddReference('AcMgd')
clr.AddReference('AcCoreMgd')
clr.AddReference('AcDbMgd')
clr.AddReference('AecBaseMgd')
clr.AddReference('AecPropDataMgd')
clr.AddReference('AeccDbMgd')

# Import references from AutoCAD
from Autodesk.AutoCAD.Runtime import *
from Autodesk.AutoCAD.ApplicationServices import *
from Autodesk.AutoCAD.EditorInput import *
from Autodesk.AutoCAD.DatabaseServices import *
from Autodesk.AutoCAD.Geometry import *

# Import references from Civil3D
from Autodesk.Civil.ApplicationServices import *
from Autodesk.Civil.DatabaseServices import *

# The inputs to this node will be stored as a list in the IN variables.
dataEnteringNode = IN

adoc = Application.DocumentManager.MdiActiveDocument
editor = adoc.Editor

with adoc.LockDocument():
    with adoc.Database as db:

        with db.TransactionManager.StartTransaction() as t:
            # Place your code below
            # 
            #

            # Commit before end transaction
            #t.Commit()
            pass

# Assign your output to the OUT variable.
OUT = IN[0][2][2:]
# ----------------------------------------
extract_9th_column_end_km = Python(IN[0]=extract_all_columns)  # CPython3
# ---------- extract_9th_column_end_km.python (43 lines) ----------
# Load the Python Standard and DesignScript Libraries
import sys
import clr

# Add Assemblies for AutoCAD and Civil3D
clr.AddReference('AcMgd')
clr.AddReference('AcCoreMgd')
clr.AddReference('AcDbMgd')
clr.AddReference('AecBaseMgd')
clr.AddReference('AecPropDataMgd')
clr.AddReference('AeccDbMgd')

# Import references from AutoCAD
from Autodesk.AutoCAD.Runtime import *
from Autodesk.AutoCAD.ApplicationServices import *
from Autodesk.AutoCAD.EditorInput import *
from Autodesk.AutoCAD.DatabaseServices import *
from Autodesk.AutoCAD.Geometry import *

# Import references from Civil3D
from Autodesk.Civil.ApplicationServices import *
from Autodesk.Civil.DatabaseServices import *

# The inputs to this node will be stored as a list in the IN variables.
dataEnteringNode = IN

adoc = Application.DocumentManager.MdiActiveDocument
editor = adoc.Editor

with adoc.LockDocument():
    with adoc.Database as db:

        with db.TransactionManager.StartTransaction() as t:
            # Place your code below
            # 
            #

            # Commit before end transaction
            #t.Commit()
            pass

# Assign your output to the OUT variable.
OUT = IN[0][8][2:]
# ----------------------------------------
extract_8th_column_start_km = Python(IN[0]=extract_all_columns)  # CPython3
# ---------- extract_8th_column_start_km.python (43 lines) ----------
# Load the Python Standard and DesignScript Libraries
import sys
import clr

# Add Assemblies for AutoCAD and Civil3D
clr.AddReference('AcMgd')
clr.AddReference('AcCoreMgd')
clr.AddReference('AcDbMgd')
clr.AddReference('AecBaseMgd')
clr.AddReference('AecPropDataMgd')
clr.AddReference('AeccDbMgd')

# Import references from AutoCAD
from Autodesk.AutoCAD.Runtime import *
from Autodesk.AutoCAD.ApplicationServices import *
from Autodesk.AutoCAD.EditorInput import *
from Autodesk.AutoCAD.DatabaseServices import *
from Autodesk.AutoCAD.Geometry import *

# Import references from Civil3D
from Autodesk.Civil.ApplicationServices import *
from Autodesk.Civil.DatabaseServices import *

# The inputs to this node will be stored as a list in the IN variables.
dataEnteringNode = IN

adoc = Application.DocumentManager.MdiActiveDocument
editor = adoc.Editor

with adoc.LockDocument():
    with adoc.Database as db:

        with db.TransactionManager.StartTransaction() as t:
            # Place your code below
            # 
            #

            # Commit before end transaction
            #t.Commit()
            pass

# Assign your output to the OUT variable.
OUT = IN[0][7][2:]
# ----------------------------------------
string = StringInput("SM_Asset")
string_2 = StringInput("TfNSW_EndKm")
string_3 = StringInput("TfNSW_StartKm")
python_script = Python(IN[0]=extract_3rd_column_object_number, IN[1]=extract_9th_column_end_km, IN[2]=extract_8th_column_start_km, IN[3]=string, IN[4]=string_2, IN[5]=string_3)  # IronPython2
# ---------- python_script.python (80 lines) ----------
import sys
import clr

# Add Assemblies for AutoCAD and Civil3D
clr.AddReference('AcMgd')
clr.AddReference('AcCoreMgd')
clr.AddReference('AcDbMgd')
clr.AddReference('AecBaseMgd')
clr.AddReference('AecPropDataMgd')
clr.AddReference('AeccDbMgd')

# Import references from AutoCAD
from Autodesk.AutoCAD.Runtime import *
from Autodesk.AutoCAD.ApplicationServices import *
from Autodesk.AutoCAD.EditorInput import *
from Autodesk.AutoCAD.DatabaseServices import *
from Autodesk.AutoCAD.Geometry import *
from Autodesk.Civil.ApplicationServices import *
from Autodesk.Civil.DatabaseServices import *
from System.Collections.Generic import List
from Autodesk.Aec.PropertyData.DatabaseServices import PropertyDataServices
from System import Array 

# DEVELOPED BY MD

# The inputs to this node will be stored as a list in the IN variables.
csv_order = IN[0]  # List of handles from CSV
End_Km = IN[1]
Start_Km = IN[2]
End_Km_Check = []
Start_Km_Check = []
PROPERTY_SET_DEF_NAME = IN[3]
PROPERTY_SET_NAME_1 = IN[4]
PROPERTY_SET_NAME_2 = IN[5]
i=0
j =0
handles = []
sorted_obj = []

adoc = Application.DocumentManager.MdiActiveDocument
editor = adoc.Editor

with adoc.LockDocument():
    with adoc.Database as db:
        with db.TransactionManager.StartTransaction() as trans:
            # Access the Block Table Record for the Model Space
            bt = trans.GetObject(db.BlockTableId, OpenMode.ForWrite)
            btr = trans.GetObject(bt[BlockTableRecord.ModelSpace], OpenMode.ForWrite)
            
            for obj_handle in csv_order:
                end_value = str(End_Km[i])
                start_value = str(Start_Km[i])
                handle_str = obj_handle.ToString()
                
                for objId in btr:
                    obj = trans.GetObject(objId, OpenMode.ForWrite)
                    if isinstance(obj, Solid3d):
                        if obj.Handle.ToString() == handle_str:
                            handles.append(obj.Handle)
                            sorted_obj.append(obj)
                            psDefsUsed = PropertyDataServices.GetPropertySets(obj)
                            for psDefId in psDefsUsed:
                                psDef = trans.GetObject(psDefId, OpenMode.ForWrite)
                                if psDef.PropertySetDefinitionName == PROPERTY_SET_DEF_NAME:
                                    id = psDef.PropertyNameToId(PROPERTY_SET_NAME_1)
                                    psDef.SetAt(id,end_value)
                                    id = psDef.PropertyNameToId(PROPERTY_SET_NAME_2)
                                    psDef.SetAt(id,start_value)
                                    End_Km_Check.append(end_value)
                                    Start_Km_Check.append(start_value)
                                    i = i+1
                                    j = j+1                                    
            				
            
            # Commit before end transaction
            trans.Commit()
            pass

# Assign your output to the OUT variable.
OUT = handles,End_Km_Check,Start_Km_Check
# ----------------------------------------
watch = Watch(python_script)
watch_2 = Watch(extract_3rd_column_object_number)
watch_3 = Watch(extract_9th_column_end_km)
watch_4 = Watch(extract_8th_column_start_km)
