# Dynamo graph UNION_Automation_V1.1 2.dyn "UNION_Automation_V1.1" (Dynamo 2.13.1.3887)

current = Autodesk.AutoCAD.DynamoNodes.Document.Current()
list_of_all_the_layers = Autodesk.AutoCAD.DynamoNodes.Document.Layers(document=current)
watch = Watch(list_of_all_the_layers)

# group: PLEASE ENTER THE DESIRED LAYER(S) INDEX
enter_the_index_number_of = CodeBlock { [2,4]; }  # "Enter the index number of Desired Layers For UNION"

list_of_the_selected_layers = List.GetItemAtIndex(list=list_of_all_the_layers, index=enter_the_index_number_of)
current_2 = Autodesk.AutoCAD.DynamoNodes.Document.Current()
modelSpace = Autodesk.AutoCAD.DynamoNodes.Document.ModelSpace(document=current_2)
all_objects_on_layer = AcObjectsOnLayer(layer=list_of_the_selected_layers, block=modelSpace)
watch_2 = Watch(all_objects_on_layer)
convert_to_object_id = Python(IN[0]=all_objects_on_layer)  # IronPython2
# ---------- convert_to_object_id.python (48 lines) ----------
# Load the Python Standard and DesignScript Libraries
import sys
import clr

# Add Assemblies for AutoCAD and Civil3D
clr.AddReference('AcMgd')
clr.AddReference('AcCoreMgd')
clr.AddReference('AcDbMgd')
clr.AddReference('AecBaseMgd')
clr.AddReference('AecPropDataMgd')
clr.AddReference('AeccDbMgd')

# Import references from AutoCAD
from Autodesk.AutoCAD.Runtime import *
from Autodesk.AutoCAD.ApplicationServices import *
from Autodesk.AutoCAD.EditorInput import *
from Autodesk.AutoCAD.DatabaseServices import *
from Autodesk.AutoCAD.Geometry import *

# Import references from Civil3D
from Autodesk.Civil.ApplicationServices import *
from Autodesk.Civil.DatabaseServices import *

# The inputs to this node will be stored as a list in the IN variables.
union_objects_list = IN[0]
union_objects_list_ids = []

for obj_list in union_objects_list:
	for obj in obj_list:
		union_objects_list_ids.append(obj.InternalObjectId)

adoc = Application.DocumentManager.MdiActiveDocument
editor = adoc.Editor

with adoc.LockDocument():
    with adoc.Database as db:

        with db.TransactionManager.StartTransaction() as t:
            # Place your code below
            # 
            #

            # Commit before end transaction
            #t.Commit()
            pass

# Assign your output to the OUT variable.
OUT = union_objects_list_ids
# ----------------------------------------
watch_3 = Watch(convert_to_object_id)

# group: SELECT MODE OF UNION
options_1_select_objects_from = IntegerSlider(3, range=1..3 step 1)  # "OPTIONS: 1 = Select Objects From The Screen 2 = Select Objects From The Screen + Provide Layer 3 = Select Objects From The Layers Only"

# group: Keep Parent Object Copies Before UNION?
keep_copy = BoolSelector(false)

union_py_script = Python(IN[0]=options_1_select_objects_from, IN[1]=keep_copy, IN[2]=convert_to_object_id)  # IronPython2
# ---------- union_py_script.python (121 lines) ----------
import clr
clr.AddReference('AcMgd')
clr.AddReference('AcCoreMgd')
clr.AddReference('AcDbMgd')
clr.AddReference('AecBaseMgd')
clr.AddReference('AecPropDataMgd')
clr.AddReference('AeccDbMgd')

from Autodesk.AutoCAD.Runtime import *
from Autodesk.AutoCAD.ApplicationServices import Application
from Autodesk.AutoCAD.DatabaseServices import *
from Autodesk.AutoCAD.EditorInput import *
from Autodesk.AutoCAD.Geometry import *
from Autodesk.Civil.ApplicationServices import *
from Autodesk.Civil.DatabaseServices import *

def are_bounding_boxes_intersecting(bounds1, bounds2):
    return (bounds1.MinPoint.X <= bounds2.MaxPoint.X and bounds1.MaxPoint.X >= bounds2.MinPoint.X and
            bounds1.MinPoint.Y <= bounds2.MaxPoint.Y and bounds1.MaxPoint.Y >= bounds2.MinPoint.Y and
            bounds1.MinPoint.Z <= bounds2.MaxPoint.Z and bounds1.MaxPoint.Z >= bounds2.MinPoint.Z)

mode = IN[0]
keep_copy = IN[1]
union_objects_list_ids= IN[2]
selected_solids_for_union = []
x = 0

adoc = Application.DocumentManager.MdiActiveDocument
editor = adoc.Editor

with adoc.LockDocument():
    with adoc.Database as db:
        with db.TransactionManager.StartTransaction() as trans:
            bt = trans.GetObject(db.BlockTableId, OpenMode.ForWrite)
            btr = trans.GetObject(bt[BlockTableRecord.ModelSpace], OpenMode.ForWrite)
            all_solids = list(union_objects_list_ids)
            
            if mode == 1:
                message = " Select Objects for Union: "
                editor.WriteMessage("\n" + message)
                prompt_selection_result = editor.GetSelection()
                if prompt_selection_result.Status == PromptStatus.OK:
                    selection_set = prompt_selection_result.Value
                    for objId in selection_set.GetObjectIds():
                        obj = trans.GetObject(objId, OpenMode.ForWrite)
                        if isinstance(obj, Solid3d):
                            selected_solids_for_union.append(objId)
                
                if selected_solids_for_union:
                    first_solid = trans.GetObject(selected_solids_for_union[0], OpenMode.ForWrite)
                    if keep_copy:
	                    for solid_id in all_solids[0:]:
	                    	solid = trans.GetObject(solid_id, OpenMode.ForWrite)
	                    	if isinstance(solid, Solid3d):
	                            cloned_solid = solid.Clone()
	                            btr.AppendEntity(cloned_solid)
	                            trans.AddNewlyCreatedDBObject(cloned_solid, True)
                    for solid_id in selected_solids_for_union[1:]:
                        solid = trans.GetObject(solid_id, OpenMode.ForWrite)
                        if isinstance(solid, Solid3d):
                            first_solid.BooleanOperation(BooleanOperationType.BoolUnite, solid)
                            first_solid = trans.GetObject(first_solid.ObjectId, OpenMode.ForWrite)
                    x = 1

            elif mode == 2:
                message = " Select Objects for Union: "
                editor.WriteMessage("\n" + message)
                prompt_selection_result = editor.GetSelection()
                if prompt_selection_result.Status == PromptStatus.OK:
                    selection_set = prompt_selection_result.Value
                    for objId in selection_set.GetObjectIds():
                        obj = trans.GetObject(objId, OpenMode.ForWrite)
                        if isinstance(obj, Solid3d):
                            selected_solids_for_union.append(objId)
                
                all_solids += selected_solids_for_union
          
                if all_solids:
                    first_solid = trans.GetObject(all_solids[0], OpenMode.ForWrite)
                    if keep_copy:
	                    for solid_id in all_solids[0:]:
	                    	solid = trans.GetObject(solid_id, OpenMode.ForWrite)
	                    	if isinstance(solid, Solid3d):
	                            cloned_solid = solid.Clone()
	                            btr.AppendEntity(cloned_solid)
	                            trans.AddNewlyCreatedDBObject(cloned_solid, True)
                    
                    for solid_id in all_solids[1:]:
                        solid = trans.GetObject(solid_id, OpenMode.ForWrite)
                        if isinstance(solid, Solid3d):
                            #if are_bounding_boxes_intersecting(first_solid.Bounds, solid.Bounds):
                            first_solid.BooleanOperation(BooleanOperationType.BoolUnite, solid)
                            first_solid = trans.GetObject(first_solid.ObjectId, OpenMode.ForWrite)
                    x = 2

            elif mode == 3:
                if all_solids:
                    first_solid = trans.GetObject(all_solids[0], OpenMode.ForWrite)
                    if keep_copy:
	                    for solid_id in all_solids[0:]:
	                    	solid = trans.GetObject(solid_id, OpenMode.ForWrite)
	                    	if isinstance(solid, Solid3d):
	                            cloned_solid = solid.Clone()
	                            btr.AppendEntity(cloned_solid)
	                            trans.AddNewlyCreatedDBObject(cloned_solid, True)
                    for solid_id in all_solids[1:]:
                        solid = trans.GetObject(solid_id, OpenMode.ForWrite)
                        if isinstance(solid, Solid3d):
                            #if are_bounding_boxes_intersecting(first_solid.Bounds, solid.Bounds):
                            first_solid.BooleanOperation(BooleanOperationType.BoolUnite, solid)
                            first_solid = trans.GetObject(first_solid.ObjectId, OpenMode.ForWrite)
                    
                    x = 3
            
            union_obj_id = first_solid.ObjectId
            
            trans.Commit()
            pass

# Assign your output to the OUT variable.
OUT = union_obj_id
# ----------------------------------------
watch_4 = Watch(union_py_script)

# group: Create New Layer of the Union Object
new_layer_name = StringInput("OBJECT-UNION-1")
this_document = Autodesk.AutoCAD.DynamoNodes.Document.Current()
color_palette = ColorPalette({R: 175, G: 238, B: 238, A: 255})
layer_name = StringInput("Continuous")
create_layer_if_the_union_object = Autodesk.AutoCAD.DynamoNodes.Layer.Create(name=new_layer_name, document=this_document, color=color_palette, linetype=layer_name)

name = Autodesk.AutoCAD.DynamoNodes.Layer.Name(layer=create_layer_if_the_union_object)
watch_5 = Watch(name)
set_layer_to_object_output = Python(IN[0]=union_py_script, IN[1]=name)  # "SET LAYER TO OBJECT + OUTPUT OBJECT"; IronPython2
# ---------- set_layer_to_object_output.python (46 lines) ----------
# Load the Python Standard and DesignScript Libraries
import sys
import clr

# Add Assemblies for AutoCAD and Civil3D
clr.AddReference('AcMgd')
clr.AddReference('AcCoreMgd')
clr.AddReference('AcDbMgd')
clr.AddReference('AecBaseMgd')
clr.AddReference('AecPropDataMgd')
clr.AddReference('AeccDbMgd')

# Import references from AutoCAD
from Autodesk.AutoCAD.Runtime import *
from Autodesk.AutoCAD.ApplicationServices import *
from Autodesk.AutoCAD.EditorInput import *
from Autodesk.AutoCAD.DatabaseServices import *
from Autodesk.AutoCAD.Geometry import *

# Import references from Civil3D
from Autodesk.Civil.ApplicationServices import *
from Autodesk.Civil.DatabaseServices import *

# The inputs to this node will be stored as a list in the IN variables.
union_obj_id = IN[0]
new_layer_name = IN[1]

adoc = Application.DocumentManager.MdiActiveDocument
editor = adoc.Editor

with adoc.LockDocument():
    with adoc.Database as db:

        with db.TransactionManager.StartTransaction() as trans:
            # Place your code below
            bt = trans.GetObject(db.BlockTableId, OpenMode.ForWrite)
            btr = trans.GetObject(bt[BlockTableRecord.ModelSpace], OpenMode.ForWrite)
            if union_obj_id is not None:
            	union_obj = trans.GetObject(union_obj_id, OpenMode.ForWrite)
            	union_obj.Layer = new_layer_name
            	final_object = union_obj
            trans.Commit()
            pass

# Assign your output to the OUT variable.
OUT = final_object
# ----------------------------------------
watch_6 = Watch(set_layer_to_object_output)

# group: Freeze Union Object Layer?
boolean = BoolSelector(false)

freeze_union_object = Python(IN[0]=boolean, IN[1]=set_layer_to_object_output)  # IronPython2
# ---------- freeze_union_object.python (41 lines) ----------
import clr
clr.AddReference('AcMgd')
clr.AddReference('AcCoreMgd')
clr.AddReference('AcDbMgd')
clr.AddReference('AecBaseMgd')
clr.AddReference('AecPropDataMgd')
clr.AddReference('AeccDbMgd')

from Autodesk.AutoCAD.Runtime import *
from Autodesk.AutoCAD.ApplicationServices import Application
from Autodesk.AutoCAD.DatabaseServices import *
from Autodesk.AutoCAD.EditorInput import *
from Autodesk.AutoCAD.Geometry import *
from Autodesk.Civil.ApplicationServices import *
from Autodesk.Civil.DatabaseServices import *

boolean_decision = IN[0]
solid3d_id = IN[1].ObjectId # Input should be ObjectId of the Solid3d

adoc = Application.DocumentManager.MdiActiveDocument
editor = adoc.Editor



with adoc.LockDocument():
	with adoc.Database as db:
		with db.TransactionManager.StartTransaction() as trans:
			bt = trans.GetObject(db.BlockTableId, OpenMode.ForWrite)
			btr = trans.GetObject(bt[BlockTableRecord.ModelSpace], OpenMode.ForWrite)
			solid3d = trans.GetObject(solid3d_id, OpenMode.ForWrite)
			if isinstance(solid3d, Solid3d):
				layer_name = solid3d.Layer
				layer_table = trans.GetObject(db.LayerTableId, OpenMode.ForRead)
				if boolean_decision:
					layer_table_record = trans.GetObject(layer_table[layer_name], OpenMode.ForWrite)
					layer_table_record.IsFrozen = True
			trans.Commit()
			pass

# Assign your output to the OUT variable.
OUT = IN[1]
# ----------------------------------------
watch_7 = Watch(freeze_union_object)
